# Grasshopper definition rainwater_flow.gh (Grasshopper 1.0.8)
# plug-ins: SonicFlow

number_slider = Slider(1328, range=0..2000)
brep = Brep(<brep referenced from the Rhino model>)
popgeo = PopulateGeometry(Geometry=brep, Count=Slider(1492, range=0..2000), Seed=number_slider)
flow = Flow(Surface=brep, Point3D=popgeo, Double=Slider(5, range=0..10), Integer=number_slider, Boolean=Toggle(True))
preview = CustomPreview(Geometry=flow, Material=ColourSwatch(SwatchColor=RGB(54, 91, 186)))
