# Grasshopper definition rockfall_simulation.gh (Grasshopper 1.0.8)

drop_height = Slider(72, range=0..500)
Z = UnitZ(Factor=drop_height)
fracture_count = Slider(15, range=2..100)
brep = Brep(<brep referenced from the Rhino model>)
assign_topo_here = Mesh([<mesh referenced from the Rhino model> x35])
Z_2 = UnitZ(Factor=1)
neg = Negative(Value=Z_2)
bbox = BoundingBox(Content=brep, Plane=PlaneXY(0, 0, 0))  # -> Box, Box_2
scale_factor = Slider(0.95, range=0..1)
pop3d = Populate3D(Region=bbox.Box, Count=fracture_count, Seed=1)
voronoi3d = Voronoi3D(Points=pop3d, Box=bbox.Box)  # -> Cells, Boundary
area = Area(Geometry=voronoi3d.Cells)  # -> Area, Centroid
scale = Scale(Geometry=voronoi3d.Cells, Center=area.Centroid, Factor=scale_factor)  # -> Geometry, Transform
brep_2 = Brep(voronoi3d.Cells)
move_up = Move(Geometry=scale.Geometry, Motion=Z)  # -> Geometry, Transform
mesh_brep = MeshBrep(
    Brep=move_up.Geometry,
    Settings={GridMaxCount=0, GridMinCount=16, JaggedSeams=False, MaxEdgeLength=0, MinEdgeLength=0.0001, MinTolerance=0, Refine=True, RefineAngle=0, RelativeTolerance=0.65, SimplePlanes=True, Tolerance=0})
deconstruct = DeconstructMesh(Mesh=mesh_brep)  # -> Vertices, Faces, Colours, Normals
load = Load(Point=flatten(deconstruct.Vertices), ForceVector=neg, Weighting=1)
spc = SolidPointCollide(Points=flatten(deconstruct.Vertices), Solid=assign_topo_here, Interior=False, Unidirectional=True, Strength=1)
rigidbody = RigidBody(Part=graft(mesh_brep), Points=deconstruct.Vertices, Strength=1)
bouncysolver = BouncySolver(
    GoalObjects=flatten([load, spc, rigidbody]),
    Reset=Button(),
    Threshold=Slider(1, range=0..1),
    Tolerance=0.0001,
    Damping=Slider(0.9, range=0..1),
    Iterations=20,
    On=Toggle(True))  # -> I, V, O
clean = CleanTree(RemoveNulls=True, RemoveInvalid=True, RemoveEmpty=False, Tree=bouncysolver.O)
preview = CustomPreview(Geometry=clean, Material=ColourSwatch(SwatchColor=RGB(82, 163, 204)))
