# Grasshopper definition slope_analysis.gh (Grasshopper 1.0.8)

geometry = Geometry(<surface referenced from the Rhino model>)
face_boundaries = FaceBoundaries(Mesh=geometry)
deconstruct_mesh = DeconstructMesh(Mesh=geometry)  # -> Vertices, Faces, Colours, Normals
unit_z = UnitZ(Factor=1)
slope_degree = Panel("""0
1:3
1:2
1:1""")
unit_vector = UnitVector(Vector=unit_z)
unit_vector_2 = UnitVector(Vector=deconstruct_mesh.Normals)
slope_degree_2 = Panel("""0
18.435
26.565
45.0""")
dot_product = DotProduct(VectorA=unit_vector_2, VectorB=unit_vector, Unitize=False)
panel = Panel(dot_product)
slope_degree_3 = Panel("""0
18.435
26.565
45.0""")
abs = Absolute(Value=dot_product)
arccosine = ArcCosine(Value=abs)
degrees = Degrees(Radians=arccosine)
consecutive_domains = ConsecutiveDomains(Numbers=slope_degree_3, Additive=Toggle(False))
slope_degree_4 = Panel(consecutive_domains)
find_domain = FindDomain(Domains=consecutive_domains, Number=degrees, Strict=False)  # -> Index, Neighbour
panel_2 = Panel(find_domain.Index)
colour_swatch = ColourSwatch(SwatchColor=RGB(255, 0, 0))
_3_1 = ColourSwatch(SwatchColor=RGB(255, 255, 255))
colour_swatch_2 = ColourSwatch(SwatchColor=RGB(255, 255, 0))
colour_swatch_3 = ColourSwatch(SwatchColor=RGB(0, 255, 0))
merge_colors = Merge(Data1=_3_1, Data2=colour_swatch_3, Data3=colour_swatch_2, Data4=colour_swatch)
list_item = ListItem(List=merge_colors, Index=find_domain.Index, Wrap=True)
panel_3 = Panel(list_item)
construct_mesh = ConstructMesh(Vertices=deconstruct_mesh.Vertices, Faces=deconstruct_mesh.Faces, Colours=list_item)
blur_mesh = BlurMesh(Mesh=construct_mesh, Iterations=1)
