# Grasshopper definition circle_packing.gh (Grasshopper 0.9.6)
# plug-ins: Kangaroo Components

mesh = Mesh(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)
mcomp = Decompose(Mesh=mesh)  # -> Vertices, Faces, Colours, Normals
medges = MeshEdges(Mesh=mesh)  # -> NakedEdges, InteriorEdges, NonManifoldEdges
lng = ListLength(List=mcomp.Vertices)
series = Series(Start=0, Step=1, Count=lng)
line = Line([medges.NakedEdges, medges.InteriorEdges])
vn = VertexNeighbours(Mesh=mesh, VertexNumber=series)  # -> graft(Vertex), Neighbours, Normal
end = EndPoints(Curve=line)  # -> Start, End
eval = EvaluateCurve(Curve=reparameterize(line), Parameter=0.5)  # -> Point, Tangent, Angle
ln = Line(StartPoint=vn.Vertex, EndPoint=vn.Neighbours)
eval_2 = EvaluateCurve(Curve=reparameterize(ln), Parameter=0.5)  # -> Point, Tangent, Angle
bend = Bend(Point1=end.Start, Point2=eval.Point, Point3=end.End, BendStrength=2000, RestAngle=0)
ln_2 = Line(StartPoint=vn.Vertex, EndPoint=eval_2.Point)
line_2 = Line(ln_2)
equalizen = EqualizeN(Lines=line_2, EqNStrength=1000)
springs = SpringsFromLine(Connection=line_2, Stiffness=0.01, Damping=10, RestLength=line_2, UpperCutoff=0, LowerCutoff=0, Plasticity=0)
kangaroo = KangarooPhysics(ForceObjects=flatten([springs, equalizen, bend]), Settings=null, Geometry=line_2, SimulationReset=Toggle(True))  # -> Out, Iterations, ParticlesOut, GeometryOut
timer = Timer(TimerInterval=5, Target=kangaroo)  # disabled
lng_2 = ListLength(List=kangaroo.GeometryOut)
crv = Curve(kangaroo.GeometryOut)
larger = LargerThan(FirstNumber=lng_2, SecondNumber=2)  # -> LargerThan, OrEqualTo
cull = CullPattern(List=kangaroo.GeometryOut, CullPattern=larger.LargerThan)
clean = CleanTree(Data=cull, CleanInvalid=True, CleanEmpty=True)
end_2 = EndPoints(Curve=clean)  # -> Start, End
fcircle = CircleFit(Points=end_2.End)  # -> Circle, Radius, Deviation
