# Grasshopper definition dome_panelization.ghx (Grasshopper 0.8.7)

sphere_radius = Slider(15, range=0..31)
subdivision_level = Slider(4, range=0..8)
# Geodesic Dome Paneling
# Gabriel Krause 2011
# http://visualcurrent.com
# Use these however you like.
data_panel = Panel("{0,0,0}")

# ---- group: Center Point
# Geodesic Dome Paneling: This provides a cleaned up (no duplicates), sorted list of components for a dodecahedron based geodesic dome. At the bottom, you'll find most of the basic geometry you could want. We have: triangle center points, vertices, members, and (the most novel) best fit paneled rings.
# 
# It was inspired by a need for best fitting similar sized rings on a sphere. Most of the rings are ovals because it was important to me that all rings connected to it's neighboring rings. There are a few circles and some polylines to fill in the gaps. To keep each polyline ring planar, as the ovals are, they mathematically couldn't join all of it's neighboring rings; so you'll see them floating slightly. If you want all rings on a spherical surface, just project them using Pull Curve To Surface command in Rhino.
# 
# Due to my need for the paneled rings, this is a pretty big definition. Additional organization went into minimizing the creation of duplicate entities. The output is provided with no duplicates. Processing can be a bit slow for higher subdivisions.
# 
# There is one component dependency. I have yet to find a better way to eliminate duplicate lines than by using the component from Kangaroo. So for this you'll have to have Kangaroo installed. (If you have a GH or VB definition that is as effective and efficient for the elimination of duplicate lines, please make me aware of it.) I would also be glad to discover other efforts to panel similar sized rings or circles on a sphere or other compound curved surfaces.
# 
# Enjoy!
pt = Point(data_panel)

# ----
xy = XYPlane(Origin=pt)
f_x = F1(Function="sqrt(5)/2")
num = Number(sphere_radius)

# ---- group: Circumscribe Radius
division = Division(A=num, B=f_x)

# ---- group: Orientation Plane
pln = Plane(xy)

# ----
division_2 = Division(A=division, B=2)
pl_offset = PlaneOffset(BasePlane=pln, Offset=expr("-O", division_2))
pl_offset_2 = PlaneOffset(BasePlane=pln, Offset=division_2)
prot = RotatePlane(Plane=pl_offset_2, Angle="2*pi/10")
polygon = Polygon(Plane=prot, Radius=division, Segments="5", FilletRadius=0)  # -> Polygon, Length
polygon_2 = Polygon(Plane=pl_offset, Radius=division, Segments="5", FilletRadius=0)  # -> Polygon, Length
explode = Explode(Curve=polygon.Polygon, Recursive=True)  # -> Segments, Vertices
explode_2 = Explode(Curve=polygon_2.Polygon, Recursive=True)  # -> Segments, Vertices
pt_2 = PointOriented(BasePlane=pln, UComponent=0, VComponent=0, WComponent=1)
num_2 = Number(sphere_radius)
num_3 = Number(sphere_radius)
item = ListItem(List=explode_2.Vertices, Index=[0, 1], Wrap=False)
item_2 = ListItem(List=explode.Vertices, Index=[0, 1], Wrap=False)
Z = UnitZ(Factor=expr("-F", num_2))
pt_3 = Point(pt)
Z_2 = UnitZ(Factor=num_3)
pt_4 = Point(pt)
pln_2 = Plane(xy)
int = Integer("5")
move = Move(Geometry=pt_3, Translation=Z)
item_3 = ListItem(List=item_2, Index=0, Wrap=False)
item_4 = ListItem(List=item, Index=0, Wrap=False)
item_5 = ListItem(List=item, Index=1, Wrap=False)
item_6 = ListItem(List=item_2, Index=1, Wrap=False)
move_2 = Move(Geometry=pt_4, Translation=Z_2)

# ---- group: source
pl_3pt = Plane3Pt(PointA=item_3, PointB=item_4, PointC=item_5)

# ---- group: Orientation Planes
pln_3 = Plane(pl_3pt)

# ---- group: destination
pl_3pt_2 = Plane3Pt(PointA=item_3, PointB=item_6, PointC=move_2)
pl_3pt_3 = Plane3Pt(PointA=item_6, PointB=item_3, PointC=item_5)
pl_3pt_4 = Plane3Pt(PointA=item_5, PointB=item_4, PointC=move)

# ---- group: Orientation Planes
pln_4 = Plane(pl_3pt_2)
pln_5 = Plane(pl_3pt_3)
pln_6 = Plane(pl_3pt_4)

# ----
dist = Distance(PointA=item_3, PointB=item_4)
int_2 = Integer(subdivision_level)

# ---- group: division length
division_3 = Division(A=dist, B=int_2)

# ----
multiplication = Multiplication(A=int_2, B=2)
int_3 = Integer(multiplication)
mod = Modulus(A=int_3, B=2)
f_x_y = F2(Function="if(B=0,x-1,x)", X=int_3, B=mod)
f_x_2 = F1(Function="Ceiling(x/2)", X=int_3)
pln_7 = Plane(pl_3pt)
trigrid = Triangular(Plane=pln_7, Size=division_3, ExtentX=int_3, ExtentY=f_x_2)  # -> Cells, Points
series = Series(Start=1, Step=1, Count=f_x_2)
# Get dodeca tri division from TriGrid.
series_2 = Series(Start=0, Step=1, Count=f_x_2)

# ---- group: Tri Corner Pts
item_7 = ListItem(List=explode.Vertices, Index=0, Wrap=False)
item_8 = ListItem(List=explode_2.Vertices, Index=0, Wrap=False)
item_9 = ListItem(List=explode_2.Vertices, Index=1, Wrap=False)

# ----
int_4 = Integer(subdivision_level)
num_4 = Number(division_3)
pt_5 = Point(data_panel)
series_3 = Series(Start=0, Step=1, Count=graft(series_2))
series_4 = Series(Start=f_x_y, Step=-1, Count=graft(series))
flip = FlipMatrix(Data=trigrid.Points)
flip_2 = FlipMatrix(Data=trigrid.Cells)
vec2pt = Vector2Pt(PointA=item_7, PointB=item_8, Unitize=True)  # -> Vector, Length
vec2pt_2 = Vector2Pt(PointA=item_7, PointB=item_9, Unitize=True)  # -> Vector, Length
vec2pt_3 = Vector2Pt(PointA=item_8, PointB=item_9, Unitize=True)  # -> Vector, Length
cull_i = CullIndex(List=flip_2, Indices=series_4, Wrap=False)
cull_i_2 = CullIndex(List=flip, Indices=series_4, Wrap=False)
series_5 = Series(Start=1, Step=1, Count=expr("C-1", int_4))
series_6 = Series(Start=1, Step=1, Count=expr("C-1", int_4))
series_7 = Series(Start=1, Step=1, Count=expr("C-1", int_4))

# ---- group: Dodeca tri edge reflection planes
pl_3pt_5 = Plane3Pt(PointA=pt_5, PointB=item_7, PointC=item_8)
pl_3pt_6 = Plane3Pt(PointA=pt_5, PointB=item_7, PointC=item_9)
pl_3pt_7 = Plane3Pt(PointA=pt_5, PointB=item_8, PointC=item_9)

# ---- group: ctr pts
cull_i_3 = CullIndex(List=cull_i_2, Indices=series_3, Wrap=False)

# ---- group: triangles
cull_i_4 = CullIndex(List=cull_i, Indices=series_3, Wrap=False)

# ----
multiplication_2 = Multiplication(A=series_5, B=num_4)
multiplication_3 = Multiplication(A=series_6, B=num_4)
multiplication_4 = Multiplication(A=series_7, B=num_4)
amp = Amplitude(Vector=vec2pt.Vector, Amplitude=multiplication_2)
amp_2 = Amplitude(Vector=vec2pt_2.Vector, Amplitude=multiplication_3)
amp_3 = Amplitude(Vector=vec2pt_3.Vector, Amplitude=multiplication_4)
explode_3 = Explode(Curve=cull_i_4, Recursive=True)  # -> Segments, Vertices
pt_6 = Point(data_panel)
num_5 = Number(sphere_radius)

# ---- group: Tri Perimeter Pts
move_3 = Move(Geometry=item_7, Translation=amp)  # -> Geometry, Transform
move_4 = Move(Geometry=item_7, Translation=amp_2)  # -> Geometry, Transform
move_5 = Move(Geometry=item_8, Translation=amp_3)  # -> Geometry, Transform

# ----
sph = Sphere(Base=pt_6, Radius=num_5)
ln = Line(PointA=explode_3.Vertices, PointB=pt_6)
blx = BrepLine(Brep=sph, Line=ln, Limit=True)  # -> Curves, Points
# Sort ovals to minimize processing time needed later to eliminate duplicate entities.
lng = ListLength(List=cull_i_4)
int_5 = Integer(subdivision_level)
pt_7 = Point(data_panel)

# ---- group: members
pline = PolyLine(Vertices=blx.Points, Closed=False)

# ----
series_8 = Series(Start=1, Step=1, Count=int_5)
disc = Discontinuity(Curve=pline, Level=1)  # -> Points, Parameters
ln_2 = Line(PointA=move_3.Geometry, PointB=pt_7)
ln_3 = Line(PointA=move_4.Geometry, PointB=pt_7)
ln_4 = Line(PointA=move_5.Geometry, PointB=pt_7)
srf = Surface(sph)
int_6 = Integer(flatten(lng))
series_9 = Series(Start=0, Step=1, Count=series_8)
item_10 = ListItem(List=int_6, Index=series_9, Wrap=False)

# ---- group: Tri Division Pts
blx_2 = BrepLine(Brep=srf, Line=ln_2, Limit=True)  # -> Curves, Points
blx_3 = BrepLine(Brep=srf, Line=ln_3, Limit=True)  # -> Curves, Points
blx_4 = BrepLine(Brep=srf, Line=ln_4, Limit=True)  # -> Curves, Points

# ----
pt_8 = Point(data_panel)
subtraction = Subtraction(A=lng, B=1)
item_11 = ListItem(List=disc.Points, Index=0, Wrap=False)
item_12 = ListItem(List=disc.Points, Index=1, Wrap=False)
item_13 = ListItem(List=disc.Points, Index=2, Wrap=False)
# Get dodeca tri corner circles.
pt_9 = Point([item_7, item_8, item_9])
ma = MassAddition(Input=item_10)  # -> Result, PartialResult
subtraction_2 = Subtraction(A=subtraction, B=1)

# ---- group: Division Ovals
inellipse = InEllipse(CornerA=item_11, CornerB=item_12, CornerC=item_13)  # -> Ellipse, Plane

# ----
item_14 = ListItem(List=pt_9, Index=0, Wrap=False)
subtraction_3 = Subtraction(A=ma.Result, B=graft(int_6))
int_7 = Integer([subtraction, subtraction_2])
vec2pt_4 = Vector2Pt(PointA=pt_8, PointB=blx_2.Points, Unitize=False)  # -> Vector, Length
vec2pt_5 = Vector2Pt(PointA=pt_8, PointB=blx_3.Points, Unitize=False)  # -> Vector, Length
vec2pt_6 = Vector2Pt(PointA=pt_8, PointB=blx_4.Points, Unitize=False)  # -> Vector, Length
flatten = FlattenTree(Data=blx_2.Points, Path="{0}")
flatten_2 = FlattenTree(Data=blx_3.Points, Path="{1}")
flatten_3 = FlattenTree(Data=blx_4.Points, Path="{2}")
vec2pt_7 = Vector2Pt(PointA=pt_8, PointB=pt_9, Unitize=False)  # -> Vector, Length
larger = LargerThan(FirstNumber=int_7, SecondNumber=0)  # -> LargerThan, OrEqualTo
# Find points along dodeca tri edges to create a periodic polyline to fit between surrounding ovals.
pl = PlaneNormal(Origin=blx_2.Points, ZAxis=vec2pt_4.Vector)
pl_2 = PlaneNormal(Origin=blx_3.Points, ZAxis=vec2pt_5.Vector)
pl_3 = PlaneNormal(Origin=blx_4.Points, ZAxis=vec2pt_6.Vector)
series_10 = Series(Start=subtraction_3, Step=1, Count=lng)
removeduplicatpts = RemoveDuplicatePoints(
    Point=flatten(blx.Points),
    Point_2=removeduplicatpts.ClusterInput,
    Point_3=removeduplicatpts.Point,
    XComponent=removeduplicatpts.ValuesA,
    YComponent=removeduplicatpts.ValuesData,
    ZComponent=removeduplicatpts.ValuesData,
    List=removeduplicatpts.XComponent,
    Step=removeduplicatpts.Panel,
    Count=removeduplicatpts.Length,
    List_2=removeduplicatpts.ValuesData,
    FirstNumber=removeduplicatpts.List,
    SecondNumber=removeduplicatpts.ValuesData,
    Boolean=flatten([removeduplicatpts.Inequality, removeduplicatpts.BooleanToggle]),
    List_3=removeduplicatpts.ValuesA,
    CullPattern=removeduplicatpts.Result,
    List_4=removeduplicatpts.Receiver,
    CullPattern_2=removeduplicatpts.Result,
    Keys=removeduplicatpts.List,
    ValuesA=removeduplicatpts.List,
    ValuesData=removeduplicatpts.List,
    ValuesData_2=removeduplicatpts.List,
    FirstNumber_2=removeduplicatpts.Series,
    SecondNumber_2=removeduplicatpts.XComponent,
    Keys_2=removeduplicatpts.Result,
    ValuesA_2=removeduplicatpts.Series,
    ValuesData_3=removeduplicatpts.XComponent,
    ValuesData_4=removeduplicatpts.YComponent,
    ValuesData_5=removeduplicatpts.ZComponent,
    List_5=removeduplicatpts.ValuesData,
    FirstNumber_3=removeduplicatpts.List,
    SecondNumber_3=removeduplicatpts.ValuesData,
    Boolean_2=flatten([removeduplicatpts.Inequality, removeduplicatpts.BooleanToggle]),
    List_6=removeduplicatpts.Receiver,
    CullPattern_3=removeduplicatpts.Result,
    List_7=removeduplicatpts.Receiver,
    CullPattern_4=removeduplicatpts.Result,
    List_8=removeduplicatpts.ValuesData,
    FirstNumber_4=removeduplicatpts.List,
    SecondNumber_4=removeduplicatpts.ValuesData,
    Boolean_3=flatten([removeduplicatpts.Inequality, removeduplicatpts.BooleanToggle]),
    A=removeduplicatpts.Boolean,
    B=removeduplicatpts.Boolean,
    C=removeduplicatpts.Boolean,
    Receiver=removeduplicatpts.ValuesData,
    Receiver_2=removeduplicatpts.ValuesData,
    Receiver_3=removeduplicatpts.ValuesData,
    ClusterOutput=removeduplicatpts.Point,
    InternalDocument_plugin_version=(0, 8, 7),
    InternalDocument_DefinitionHeader_HandleRhinoEvents=True,
    InternalDocument_DefinitionHeader_HandleHopperEvents=True,
    InternalDocument_DefinitionHeader_PreviewNormal=RGBA(150, 0, 0, 150),
    InternalDocument_DefinitionHeader_PreviewSelected=RGBA(0, 150, 0, 150),
    InternalDocument_DefinitionProperties_Projection_Zoom=0.262144029)

# ---- group: Div Region Ctr Pts
avr = Average(Input=disc.Points)

# ---- group: Tri Division Pts
pt_10 = Point([flatten, flatten_2, flatten_3])

# ----
pl_4 = PlaneNormal(Origin=pt_9, ZAxis=vec2pt_7.Vector)
cull = CullPattern(List=int_7, CullPattern=larger.OrEqualTo)
pt_11 = Point(data_panel)

# ---- group: Branched by Row
item_15 = ListItem(List=flatten(inellipse.Ellipse), Index=series_10, Wrap=False)

# ----
ln_5 = Line(PointA=pt_11, PointB=pt_9)
# Fill internal dodeca tri gaps with a periodic spline that fit inside surrounding ovals.
crv_cp = CurveCP(Point=graft(removeduplicatpts), Curve=flatten(inellipse.Ellipse))  # -> Point, Parameter, Distance
dist_2 = Distance(PointA=graft(removeduplicatpts), PointB=flatten(avr))
item_16 = ListItem(List=item_15, Index=cull, Wrap=False)
cull_i_5 = CullIndex(List=item_15, Indices=cull, Wrap=False)
sort = SortList(Keys=dist_2, ValuesA=crv_cp.Point)  # -> List, ValuesA
series_11 = Series(Start=0, Step=1, Count=6)
series_12 = Series(Start=0, Step=1, Count=3)
cull_i_6 = CullIndex(List=cull_i_5, Indices="0", Wrap=False)

# ---- group: closest 6
item_17 = ListItem(List=sort.ValuesA, Index=series_11, Wrap=False)

item_18 = ListItem(List=sort.List, Index=series_11, Wrap=False)

# ----
num_6 = Number(division_3)
pt_12 = Point(data_panel)
item_19 = ListItem(List=cull_i_5, Index="0", Wrap=False)
item_20 = ListItem(List=cull_i_6, Index="0", Wrap=False)
cull_i_7 = CullIndex(List=cull_i_6, Indices="0", Wrap=False)
smaller = SmallerThan(FirstNumber=num_6, SecondNumber=item_18)  # -> SmallerThan, OrEqualTo
clean = CleanTree(Data=item_20, CleanInvalid=True, CleanEmpty=False)
clean_2 = CleanTree(Data=cull_i_7, CleanInvalid=True, CleanEmpty=False)
clean_3 = CleanTree(Data=item_19, CleanInvalid=True, CleanEmpty=False)
int_8 = Integer(subdivision_level)
ma_2 = MassAddition(Input=smaller.SmallerThan)  # -> Result, PartialResult
series_13 = Series(Start=1, Step=1, Count=expr("C-1", int_8))
simplify_all = SimplifyAll(
    Data=clean_2,
    Branch=simplify_all.ParamViewer,
    Data_2=simplify_all.Data,
    Search=simplify_all.ParamViewer,
    Replace=flatten(simplify_all.Branch),
    ParamViewer=simplify_all.Data,
    SimplifiedD=simplify_all.Data,
    Data_3=simplify_all.ClusterInput,
    Data_4=simplify_all.Indices,
    Input=simplify_all.Data,
    FirstNumber=simplify_all.Pan,
    SecondNumber=simplify_all.Result,
    List=simplify_all.Data,
    DispatchPattern=invert(simplify_all.Equality),
    Data_5=simplify_all.ListA,
    Data_6=simplify_all.Data,
    Index=simplify_all.Data,
    ClusterOutput=simplify_all.Data,
    InternalDocument_plugin_version=(0, 8, 7),
    InternalDocument_DefinitionHeader_HandleRhinoEvents=True,
    InternalDocument_DefinitionHeader_HandleHopperEvents=True,
    InternalDocument_DefinitionHeader_PreviewNormal=RGBA(150, 0, 0, 100),
    InternalDocument_DefinitionHeader_PreviewSelected=RGBA(0, 120, 0, 100),
    InternalDocument_DefinitionProperties_Projection_Zoom=0.8)
flip_3 = FlipMatrix(Data=ma_2.Result)
viewer = ParamViewer(ma_2.Result)
item_index = ItemIndex(
    List=flip_3,
    FirstNumber=0,
    FirstNumber_2=item_index.ClusterInput,
    SecondNumber=item_index.List,
    List_2=item_index.ClusterInput,
    Tree=item_index.ListA,
    ClusterOutput=item_index.Tree,
    Count=item_index.Length,
    List_3=item_index.List,
    Integer=item_index.Series,
    List_4=item_index.Integer,
    DispatchPattern=item_index.Equality,
    Tree_2=item_index.ListB,
    ClusterOutput_2=item_index.Tree,
    InternalDocument_plugin_version=(0, 8, 7),
    InternalDocument_DefinitionHeader_HandleRhinoEvents=True,
    InternalDocument_DefinitionHeader_HandleHopperEvents=True,
    InternalDocument_DefinitionHeader_PreviewNormal=RGBA(150, 0, 0, 100),
    InternalDocument_DefinitionHeader_PreviewSelected=RGBA(0, 120, 0, 100),
    InternalDocument_DefinitionProperties_Projection_Zoom=0.8)  # -> I, M
branch = TreeBranch(Tree=simplify_all, Path="{0}")

# ---- group: Tri Central Ovals
branch_2 = TreeBranch(Tree=simplify_all, Path=series_13)

# ----
# Sort Permeter points radially so polyline doesn't self intersect.
pln_8 = Plane(pl)
pln_9 = Plane(pl_3)
pt_13 = Point(blx_3.Points)
pt_14 = Point(blx_4.Points)
pln_10 = Plane(pl_2)
pt_15 = Point(blx_2.Points)

# ---- group: Tri perimeter Ovals
crv = Curve(flatten([clean_3, item_16, clean, branch]))

crv_2 = Curve(flatten(crv))

# ----
crv_cp_2 = CurveCP(Point=item_14, Curve=crv_2)  # -> Point, Parameter, Distance
sort_2 = SortList(Keys=crv_cp_2.Distance, ValuesA=crv_cp_2.Point)  # -> List, ValuesA
crv_cp_3 = CurveCP(Point=graft(blx_2.Points), Curve=flatten(crv_2))  # -> Point, Parameter, Distance
crv_cp_4 = CurveCP(Point=graft(blx_3.Points), Curve=flatten(crv_2))  # -> Point, Parameter, Distance
crv_cp_5 = CurveCP(Point=graft(blx_4.Points), Curve=flatten(crv_2))  # -> Point, Parameter, Distance
item_21 = ListItem(List=sort_2.ValuesA, Index=0, Wrap=False)
dist_3 = Distance(PointA=graft(blx_2.Points), PointB=crv_cp_3.Point)
dist_4 = Distance(PointA=graft(blx_3.Points), PointB=crv_cp_4.Point)
dist_5 = Distance(PointA=graft(blx_4.Points), PointB=crv_cp_5.Point)
pull = PullPoint(Point=item_21, Geometry=ln_5, Closest=True)  # -> ClosestPoint, Distance
dist_6 = Distance(PointA=item_14, PointB=pull.ClosestPoint)
dist_7 = Distance(PointA=item_21, PointB=pull.ClosestPoint)
sort_3 = SortList(Keys=dist_3, ValuesA=crv_cp_3.Point)  # -> List, ValuesA
sort_4 = SortList(Keys=dist_4, ValuesA=crv_cp_4.Point)  # -> List, ValuesA
sort_5 = SortList(Keys=dist_5, ValuesA=crv_cp_5.Point)  # -> List, ValuesA
pl_offset_3 = PlaneOffset(BasePlane=pl_4, Offset=expr("-O", dist_6))
item_22 = ListItem(List=sort_3.ValuesA, Index=series_12, Wrap=False)
item_23 = ListItem(List=sort_4.ValuesA, Index=series_12, Wrap=False)
item_24 = ListItem(List=sort_5.ValuesA, Index=series_12, Wrap=False)
pcomp = PlaneComponents(Plane=pl_offset_3)  # -> Origin, XAxis, YAxis, ZAxis
ln_6 = Line(PointA=pt_12, PointB=item_22)
ln_7 = Line(PointA=pt_12, PointB=item_23)
ln_8 = Line(PointA=pt_12, PointB=item_24)

# ---- group: Tri Tip Circles
circle = CircleCNR(Center=pcomp.Origin, Normal=pl_offset_3, Radius=dist_7)

# ----
plx = LinePlane(Line=ln_6, Plane=graft(pl))  # -> Point, ParamL, ParamP
plx_2 = LinePlane(Line=ln_7, Plane=graft(pl_2))  # -> Point, ParamL, ParamP
plx_3 = LinePlane(Line=ln_8, Plane=graft(pl_3))  # -> Point, ParamL, ParamP
mirror = Mirror(Geometry=plx.Point, Plane=pl_3pt_5)  # -> Geometry, Transform
mirror_2 = Mirror(Geometry=plx_2.Point, Plane=pl_3pt_6)  # -> Geometry, Transform
mirror_3 = Mirror(Geometry=plx_3.Point, Plane=pl_3pt_7)  # -> Geometry, Transform
item_25 = ListItem(List=viewer, Index=item_index.I, Wrap=False)
pt_16 = Point([plx.Point, mirror.Geometry])
pt_17 = Point([mirror_2.Geometry, plx_2.Point])
pt_18 = Point([mirror_3.Geometry, plx_3.Point])

# ---- group: mid Tri spline centers
item_26 = ListItem(List=removeduplicatpts, Index=item_index.I, Wrap=False)

# ---- group: mid Tri spline pts
branch_3 = TreeBranch(Tree=item_17, Path=item_25)

# ----
vec2pt_8 = Vector2Pt(PointA=graft(pt_15), PointB=pt_16, Unitize=False)  # -> Vector, Length
vec2pt_9 = Vector2Pt(PointA=graft(pt_14), PointB=pt_18, Unitize=False)  # -> Vector, Length
vec2pt_10 = Vector2Pt(PointA=graft(pt_13), PointB=pt_17, Unitize=False)  # -> Vector, Length
pcomp_2 = PlaneComponents(Plane=pln_8)  # -> Origin, XAxis, YAxis, ZAxis
pcomp_3 = PlaneComponents(Plane=pln_9)  # -> Origin, XAxis, YAxis, ZAxis
pcomp_4 = PlaneComponents(Plane=pln_10)  # -> Origin, XAxis, YAxis, ZAxis
graft = GraftTree(Data=item_26, Strip=False)
pt_19 = Point(data_panel)
angle = Angle(VectorA=graft(pcomp_2.XAxis), VectorB=vec2pt_8.Vector, Plane=graft(pln_8))  # -> Angle, Reflex
angle_2 = Angle(VectorA=graft(pcomp_3.XAxis), VectorB=vec2pt_9.Vector, Plane=graft(pln_9))  # -> Angle, Reflex
angle_3 = Angle(VectorA=graft(pcomp_4.XAxis), VectorB=vec2pt_10.Vector, Plane=graft(pln_10))  # -> Angle, Reflex
vec2pt_11 = Vector2Pt(PointA=pt_19, PointB=graft, Unitize=False)  # -> Vector, Length
ln_9 = Line(PointA=branch_3, PointB=pt_19)
pl_5 = PlaneNormal(Origin=graft, ZAxis=graft(vec2pt_11.Vector))
sort_6 = SortList(Keys=angle.Angle, ValuesA=pt_16)  # -> List, ValuesA
sort_7 = SortList(Keys=angle_2.Angle, ValuesA=pt_18)  # -> List, ValuesA
sort_8 = SortList(Keys=angle_3.Angle, ValuesA=pt_17)  # -> List, ValuesA
plx_4 = LinePlane(Line=ln_9, Plane=pl_5)  # -> Point, ParamL, ParamP
pcomp_5 = PlaneComponents(Plane=pl_5)  # -> Origin, XAxis, YAxis, ZAxis

# ---- group: Edge Splines
intcrv = Interpolate(Vertices=sort_6.ValuesA, Degree=3, Periodic=True)  # -> Curve, Length, Domain
intcrv_2 = Interpolate(Vertices=sort_8.ValuesA, Degree=3, Periodic=True)  # -> Curve, Length, Domain
intcrv_3 = Interpolate(Vertices=sort_7.ValuesA, Degree=3, Periodic=True)  # -> Curve, Length, Domain

# ----
vec2pt_12 = Vector2Pt(PointA=pcomp_5.Origin, PointB=plx_4.Point, Unitize=False)  # -> Vector, Length
flatten_4 = FlattenTree(Data=intcrv.Curve, Path="{0}")
flatten_5 = FlattenTree(Data=intcrv_2.Curve, Path="{1}")
flatten_6 = FlattenTree(Data=intcrv_3.Curve, Path="{2}")
angle_4 = Angle(VectorA=pcomp_5.XAxis, VectorB=vec2pt_12.Vector, Plane=pl_5)  # -> Angle, Reflex
crv_3 = Curve([flatten_4, flatten_5, flatten_6])
sort_9 = SortList(Keys=angle_4.Angle, ValuesA=plx_4.Point)  # -> List, ValuesA

# ---- group: Inside Splines
intcrv_4 = Interpolate(Vertices=sort_9.ValuesA, Degree=3, Periodic=True)  # -> Curve, Length, Domain

# ---- group: Tri perimeter Ovals
crv_4 = Curve(flatten(crv))

# ---- group: Tri mid central Ovals
crv_5 = Curve(flatten(branch_2))

# ---- group: Tri Corner Pts
pt_20 = Point([item_7, item_8, item_9])

# ---- group: Tri Division Pts
pt_21 = Point(pt_10)

# ---- group: Tri Inside Div Pts
pt_22 = Point(item_26)

# ---- group: Div Region Ctr Pts
pt_23 = Point(avr)

# ---- group: Member Polygons
crv_6 = Curve(pline)

# ---- group: Tri Tip Circles
circle_2 = Circle(circle)

# ---- group: Edge Splines
crv_7 = Curve(crv_3)

# ---- group: Inside Tri Splines
crv_8 = Curve(intcrv_4.Curve)

# ----
flatten_7 = FlattenTree(Data=pt_20, Path="0")

# ---- group: Tri Corner Pts
pt_24 = Point(flatten_7)

# ----
flatten_8 = FlattenTree(Data=pt_21, Path="1")

# ---- group: Tri Division Pts
pt_25 = Point(flatten_8)

# ----
flatten_9 = FlattenTree(Data=pt_22, Path="2")

# ---- group: Tri Inside Pts
pt_26 = Point(flatten_9)

# ----
flatten_10 = FlattenTree(Data=pt_23, Path="3")

# ---- group: Div Region Ctr Pts
pt_27 = Point(flatten_10)

# ----
flatten_11 = FlattenTree(Data=crv_6, Path="4")

# ---- group: Member Polygons
crv_9 = Curve(flatten_11)

# ----
flatten_12 = FlattenTree(Data=circle_2, Path="5")

# ---- group: Tri Tip Circles
circle_3 = Circle(flatten_12)

# ----
flatten_13 = FlattenTree(Data=crv_4, Path="6")

# ---- group: Tri perimeter Ovals
crv_10 = Curve(flatten_13)

# ----
flatten_14 = FlattenTree(Data=crv_5, Path="7")

# ---- group: Tri mid central Ovals
crv_11 = Curve(flatten_14)

# ----
flatten_15 = FlattenTree(Data=crv_7, Path="8")

# ---- group: Edge Splines
crv_12 = Curve(flatten_15)

# ----
flatten_16 = FlattenTree(Data=crv_8, Path="9")

# ---- group: Inside Tri Splines
crv_13 = Curve(flatten_16)

# ----
geom = Data([pt_24, crv_11, pt_25, crv_10, crv_13, crv_9, pt_26, pt_27, circle_3, crv_12])
orient = Orient(Geometry=geom, Initial=pln_3, Final=pln_5)  # -> Geometry, Transform
orient_2 = Orient(Geometry=geom, Initial=pln_3, Final=pln_6)  # -> Geometry, Transform
orient_3 = Orient(Geometry=geom, Initial=pln_3, Final=pln_4)  # -> Geometry, Transform
orient_4 = Orient(Geometry=geom, Initial=pln_3, Final=pln_3)  # -> Geometry, Transform
geom_2 = Data([orient_4.Geometry, orient_3.Geometry, orient.Geometry, orient_2.Geometry])
radialarrayplane = RadialArrayPlane(
    Data=geom_2,
    Integer=int,
    Plane=pln_2,
    ClusterOutput=radialarrayplane.Data,
    Count=radialarrayplane.Integer,
    SecondNumber=radialarrayplane.Integer,
    FirstNumber=radialarrayplane.Result,
    SecondNumber_2=radialarrayplane.Series,
    Data_2=radialarrayplane.ClusterInput,
    Integer_2=radialarrayplane.ClusterInput,
    ParamViewer=radialarrayplane.Tree,
    ParamViewer_2=radialarrayplane.Data,
    List=radialarrayplane.Data,
    List_2=radialarrayplane.ParamViewer,
    Count_2=radialarrayplane.Length,
    Integer_3=graft(radialarrayplane.Series),
    DataPanel=radialarrayplane.Length,
    Data_3=radialarrayplane.Integer,
    Length=radialarrayplane.Integer,
    Integer_4=radialarrayplane.Length,
    Integer_5=flatten(radialarrayplane.Data),
    Data_4=radialarrayplane.ClusterInput,
    DataPanel_2=radialarrayplane.Length,
    ClusterOutput_2=radialarrayplane.Integer,
    Data_5=radialarrayplane.Data,
    Data_6=radialarrayplane.Integer,
    Number=radialarrayplane.Integer,
    Order=radialarrayplane.BooleanToggle,
    Data_7=radialarrayplane.Tree,
    Search=radialarrayplane.ParamViewer,
    Replace=radialarrayplane.Data,
    Data_8=radialarrayplane.Geometry,
    Index=graft(radialarrayplane.Data),
    Data_9=radialarrayplane.Branch,
    Geometry=flatten(radialarrayplane.Data),
    Angle=graft(radialarrayplane.Result),
    Plane_2=radialarrayplane.Plane,
    Plane_3=radialarrayplane.ClusterInput,
    InternalDocument_plugin_version=(0, 8, 7),
    InternalDocument_DefinitionHeader_HandleRhinoEvents=True,
    InternalDocument_DefinitionHeader_HandleHopperEvents=True,
    InternalDocument_DefinitionHeader_PreviewNormal=RGBA(150, 0, 0, 150),
    InternalDocument_DefinitionHeader_PreviewSelected=RGBA(0, 150, 0, 150),
    InternalDocument_DefinitionProperties_Projection_Zoom=0.640000045,
    InternalDocument_DefinitionObjects_Object7_Container_DataComparison="cross_reference",
    InternalDocument_DefinitionObjects_Object11_Container_ClusterInput=radialarrayplane,
    InternalDocument_DefinitionObjects_Object11_Container_ClusterOutput=radialarrayplane,
    InternalDocument_DefinitionObjects_Object11_Container_InternalDocument_plugin_version=(0, 8, 7))

# ---- group: The Goods
# Sorting of geodesic components and duplicate elimination. Output titles match input titles to the left.
# Use PullToSurface in Rhino to project these curves to a sphere for surface paneling where all neighboring edges connect.
branch_4 = TreeBranch(Tree=radialarrayplane, Path="{0}")
branch_5 = TreeBranch(Tree=radialarrayplane, Path="{1}")
branch_6 = TreeBranch(Tree=radialarrayplane, Path="{2}")
branch_7 = TreeBranch(Tree=radialarrayplane, Path="{3}")
branch_8 = TreeBranch(Tree=radialarrayplane, Path="{4}")
branch_9 = TreeBranch(Tree=radialarrayplane, Path="{5}")
branch_10 = TreeBranch(Tree=radialarrayplane, Path="{6}")
branch_11 = TreeBranch(Tree=radialarrayplane, Path="{7}")
branch_12 = TreeBranch(Tree=radialarrayplane, Path="{8}")
branch_13 = TreeBranch(Tree=radialarrayplane, Path="{9}")
explode_4 = Explode(Curve=branch_8, Recursive=True)  # -> Segments, Vertices
cen = Center(Arc=branch_9)  # -> Center, Radius
remove_dup = VBScript(pts=branch_5)  # -> out, A, B; inputs pts: tree of Point3d
# ---------- remove_dup: VB ----------
    Dim new_pts As New list(Of point3d)
    Dim indx_map As New datatree(Of int32)
    Dim new_path As gh_path = Nothing
    Dim pts1 As List(Of point3d) = Nothing
    Dim pt1, pt2 As point3d
    Dim i,j,k As int32
    Dim dup As Boolean

    For i = 0 To pts.BranchCount - 1
      pts1 = pts.Branch(i)
      new_path = pts.Path(i)

      For j = 0 To pts1.Count - 1
        pt1 = pts1(j)
        dup = False

        For k = 0 To new_pts.count - 1
          pt2 = new_pts(k)

          If SumDev(pt1, pt2) < doc.ModelAbsoluteTolerance Then
            indx_map.add(k, new_path)
            dup = True
            Exit For
          End If

        Next

        If Not dup Then
          new_pts.add(pt1)
          indx_map.add(new_pts.count - 1, new_path)
        End If

      Next

    Next


    A = new_pts
    B = indx_map
# ---------- remove_dup: VB additional code ----------
  Private Function Sumdev(p1 As point3d, p2 As point3d)As Double
    Return (math.Abs(p1.X - p2.X) + math.Abs(p1.Y - p2.Y) + math.Abs(p1.Z - p2.Z))
  End Function
# ---------- end remove_dup ----------
remove_dup_2 = VBScript(pts=branch_4)  # -> out, A, B; inputs pts: tree of Point3d; same code as remove_dup
sort_10 = SortList(Keys=remove_dup.B, ValuesA=branch_12)  # -> List, ValuesA
dupln = RemoveDuplicateLines(Lines=flatten(explode_4.Segments), Tolerance=0.01)
shift = ShiftList(List=sort_10.List, Shift=1, Wrap=True)
remove_dup_3 = VBScript(pts=cen.Center)  # -> out, A, B; inputs pts: tree of Point3d; same code as remove_dup
pt_28 = Point(data_panel)
equals = Equality(FirstNumber=sort_10.List, SecondNumber=shift)  # -> Equality, Inequality
vec2pt_13 = Vector2Pt(PointA=pt_28, PointB=remove_dup_3.A, Unitize=False)  # -> Vector, Length
cull_2 = CullPattern(List=sort_10.ValuesA, CullPattern=equals.Inequality)
pl_6 = PlaneNormal(Origin=remove_dup_3.A, ZAxis=vec2pt_13.Vector)
item_27 = ListItem(List=cen.Radius, Index=0, Wrap=False)
circle_4 = CircleCNR(Center=remove_dup_3.A, Normal=pl_6, Radius=item_27)

# ---- group: The Goods / Tri Division Pts
pt_29 = Point(remove_dup.A)

# ---- group: The Goods / Tri Corner Pts
pt_30 = Point(remove_dup_2.A)

# ---- group: The Goods / Best Fit Ring Paneling
crv_14 = Curve(flatten([circle_4, branch_10, branch_11, cull_2, branch_13]))

# ---- group: The Goods / Vertices
pt_31 = Point([pt_30, pt_29, branch_6])

# ---- group: The Goods / Tri Ctr Pts
pt_32 = Point(branch_7)

# ---- group: The Goods / members
line = Line(dupln)
