# Grasshopper definition 2.1%20shalter.gh (Grasshopper 1.0.7)

number_slider = Slider(0.1, range=0..2000)
pt = Point([<point referenced from the Rhino model> x10])
pt_2 = Point([<point referenced from the Rhino model> x10])
nurbs = NurbsCurve(Vertices=pt, Degree=3, Periodic=True)  # -> Curve, Length, Domain
nurbs_2 = NurbsCurve(Vertices=pt_2, Degree=3, Periodic=True)  # -> Curve, Length, Domain

pipe = Pipe(Curve=nurbs_2.Curve, Radius=number_slider, Caps=0)
number_slider_2 = Slider(200, range=0..1000)
divide = DivideCurve(Curve=nurbs.Curve, Count=number_slider_2, Kinks=False)  # -> Points, Tangents, Parameters
divide_2 = DivideCurve(Curve=nurbs_2.Curve, Count=number_slider_2, Kinks=False)  # -> Points, Tangents, Parameters
shift = ShiftList(List=divide_2.Points, Shift=Slider(354, range=0..1000), Wrap=True)
shift_2 = ShiftList(List=divide.Points, Shift=Slider(0, range=0..900), Wrap=True)
ln = Line(StartPoint=shift, EndPoint=shift_2)

pipe_2 = Pipe(Curve=nurbs.Curve, Radius=number_slider, Caps=0)
cap = CapHoles(Brep=pipe)
cap_2 = CapHoles(Brep=pipe_2)
number_slider_3 = Slider(0.03, range=0..10)
loft = Loft(Curves=ln, Options={Adjust=False, Closed=True, LoftEnds=0, LoftSimp=0, LoftType=0, Rebuild=10, Refit=0.01})
pipe_3 = Pipe(Curve=ln, Radius=number_slider_3, Caps=0)

item = ListItem(List=ln, Index=0, Wrap=True)
item_2 = ListItem(List=ln, Index=450, Wrap=True)
pipe_4 = Pipe(Curve=item, Radius=number_slider_3, Caps=0)
pipe_5 = Pipe(Curve=item_2, Radius=number_slider_3, Caps=0)
gradient = Gradient(LowerLimit=pipe_4, UpperLimit=pipe_5, Parameter=pipe_3, stops=[0.0407: RGB(255, 255, 255), 0.488: RGB(15, 48, 65)])
preview = CustomPreview(Geometry=pipe_3, Material=gradient)  # disabled
