# Grasshopper definition Offset%20Pattern.gh (Grasshopper 1.0.7)

series = Series(Start=1, Step=1, Count=Slider(5, range=0..10))
crv = Curve(<curve referenced from the Rhino model>)
flip = FlipCurve(Curve=graft(crv))  # -> Curve, Flag
graph = GraphMapper(series, x0=0, x1=1, y0=0, y1=1, Ox=0, Oy=0, Px=0.5889766216, Py=0.1468474865, container_name="Parabola")
number_slider = Slider(35, range=0..100)
offset = OffsetCurve(Curve=flip.Curve, Distance=graph, Plane=PlaneXY(0, 0, 0), Corners=1)
ext = ExtendCurve(Curve=offset, Type=1, Start=number_slider, End=number_slider)
pipe = Pipe(Curve=offset, Radius=Slider(0.075, range=0..0.1), Caps=0)
