# Grasshopper definition Starty%20Nights.gh (Grasshopper 1.0.7)

brep = Brep([<brep referenced from the Rhino model> x97])
area = Area(Geometry=brep)  # -> Area, Centroid
multiplication = Multiplication(A=area.Area, B=Slider(0.01, range=0..0.1))
int = Integer(multiplication)
popgeo = PopulateGeometry(Geometry=brep, Count=int, Seed=1)
cyl = Cylinder(Base=popgeo, Radius=Slider(0.05, range=0..0.1), Length=Slider(0.16, range=0..1))
