# Grasshopper definition lofting_lattice_with_grid.gh (Grasshopper 1.0.8)

# ---- group: Clean Loft Logic
crv = Curve([<curve referenced from the Rhino model> x4])
area = Area(Geometry=crv)  # -> Area, Centroid
depoint = DeconstructPoint(Point=area.Centroid, System=PlaneXY(0, 0, 0))  # -> XCoordinate, YCoordinate, ZCoordinate
sort = SortList(Keys=depoint.XCoordinate, ValuesA=crv)  # -> Keys, ValuesA
item = ListItem(List=sort.ValuesA, Index=Slider(4, range=1..4), Wrap=True)
flip = FlipCurve(Curve=sort.ValuesA, Guide=item)  # -> Curve, Flag
end = EndPoints(Curve=item)  # -> Start, End
crv_cp = CurveClosestPoint(Point=end.Start, Curve=flip.Curve)  # -> Point, Parameter, Distance
seam = Seam(Curve=flip.Curve, Seam=crv_cp.Parameter)
loft = Loft(Curves=seam, Options={Adjust=False, Closed=False, LoftEnds=0, LoftSimp=0, LoftType=0, Rebuild=10, Refit=0.01})
preview = CustomPreview(Geometry=loft, Material=ColourSwatch(SwatchColor=RGB(102, 170, 204)))

# ---- group: contour
geo = Geometry(loft)
py3 = Python3Script(geo=geo, spacing=Slider(0.6, range=0..1), depth=Slider(4, range=0..100), gap=Slider(0.2, range=0..0.2))  # -> debug, slabs; inputs geo: Brep
# ---------- py3: Python ----------
import Rhino
import Rhino.Geometry as rg
import Rhino.Geometry.Intersect as ri
import scriptcontext as sc

# ── INPUTS ────────────────────────────────────────────────
# geo     — Surface / Brep / Mesh   (No type hint)
#           feed a Surface/Brep for SMOOTH curves (direct NURBS cut)
# spacing — float  Z pitch: top-to-top distance between steps.
# gap     — float  empty Z space between steps (step height = spacing-gap)
# depth   — float  horizontal tread depth (the RED dimension).
#                  leave at 0 to auto-default to spacing*2
# ─────────────────────────────────────────────────────────

slabs = []
log   = []

tol      = sc.doc.ModelAbsoluteTolerance
_spacing = float(spacing)
try:
    _depth = float(depth)
except (NameError, TypeError):
    _depth = 0.0
try:
    _gap = float(gap)
except (NameError, TypeError):
    _gap = 0.0

raw = geo.Value if hasattr(geo, "Value") else geo
log.append("input type: {}".format(type(raw).__name__))

# ── coerce to a Brep for smooth (mesh-free) intersection ──
if   isinstance(raw, rg.Brep):    brep = raw
elif isinstance(raw, rg.Surface): brep = raw.ToBrep()
else:                             brep = None        # Mesh input

# ── prepare a mesh only if we have no brep (or as fallback) ─
mesh = None
if isinstance(raw, rg.Mesh):
    mesh = rg.Mesh()
    mesh.Append(raw)
    mesh.Weld(0.1)

if brep is None and mesh is None:
    debug = "\n".join(log) + "\nFAIL: unsupported input"
else:
    bbox  = (brep or mesh).GetBoundingBox(True)
    diag  = bbox.Min.DistanceTo(bbox.Max)
    z_min = bbox.Min.Z
    z_max = bbox.Max.Z
    step   = max(_spacing, tol)
    slab_h = max(step - _gap, tol)
    _count = max(1, int((z_max - z_min) / step))

    if _depth <= 0:
        _depth = step * 2.0
    half  = _depth * 0.5
    style = rg.CurveOffsetCornerStyle.Sharp

    # ── decide intersection mode with a probe at mid-height ─
    mode = "mesh"
    if brep is not None:
        zt = (z_min + z_max) * 0.5
        pt = rg.Plane(rg.Point3d(0, 0, zt), rg.Vector3d.ZAxis)
        rc = ri.Intersection.BrepPlane(brep, pt, tol)
        if rc[0] and rc[1] and len(rc[1]) > 0:
            mode = "brep"            # smooth NURBS cut works

    # build a fine fallback mesh if brep cut failed
    if mode == "mesh" and mesh is None:
        mp = rg.MeshingParameters()
        mp.Tolerance         = diag * 0.0006
        mp.MaximumEdgeLength = diag * 0.008
        mp.JaggedSeams       = False
        mp.RefineGrid        = True
        mesh = rg.Mesh()
        for x in (rg.Mesh.CreateFromBrep(brep, mp) or []):
            mesh.Append(x)
        mesh.Weld(0.1)

    log.append("mode={}  Z {:.2f}-{:.2f}  spacing {:.3f}  gap {:.3f}  "
               "step_h {:.3f}  count {}  depth {:.3f}".format(
               mode, z_min, z_max, step, _gap, slab_h, _count, _depth))

    # ── get section curves at a plane (smooth if brep mode) ──
    def sections_at(plane):
        if mode == "brep":
            rc = ri.Intersection.BrepPlane(brep, plane, tol)
            if rc[0] and rc[1]:
                return list(rc[1])
            return []
        out = []
        pls = ri.Intersection.MeshPlane(mesh, plane)
        if pls:
            for pl in pls:
                if pl is not None and pl.Count >= 2:
                    c = pl.ToNurbsCurve()
                    if c:
                        out.append(c)
        return out

    # ── smooth ONLY faceted (degree-1) curves from a mesh ────
    def clean(crv):
        if crv.Degree > 1:
            return crv                       # already smooth NURBS
        length = crv.GetLength()
        n = max(min(int(length / max(step, tol)), 120), 8)
        rb = crv.Rebuild(n, 3, True)
        return rb if rb else crv

    def offset_side(crv, dist, plane):
        res = crv.Offset(plane, dist, tol, style)
        if not res:
            return None
        if len(res) == 1:
            return res[0]
        j = rg.Curve.JoinCurves(res, tol * 5)
        return j[0] if j else res[0]

    def tread_outline(crv, plane):
        crv = clean(crv)
        oc = offset_side(crv,  half, plane)
        ic = offset_side(crv, -half, plane)
        if oc is None or ic is None:
            return None
        if crv.IsClosed:
            return [oc, ic]
        ic_rev = ic.DuplicateCurve()
        ic_rev.Reverse()
        cap1 = rg.LineCurve(oc.PointAtEnd,     ic_rev.PointAtStart)
        cap2 = rg.LineCurve(ic_rev.PointAtEnd, oc.PointAtStart)
        loop = rg.Curve.JoinCurves([oc, cap1, ic_rev, cap2], tol * 5)
        if loop and loop[0].IsClosed:
            return [loop[0]]
        return None

    levels   = 0
    ok       = 0
    fat      = 0
    off_fail = 0

    for i in range(_count):
        z     = z_min + step * i + step * 0.5
        plane = rg.Plane(rg.Point3d(0, 0, z), rg.Vector3d.ZAxis)

        crvs = sections_at(plane)
        if not crvs:
            continue

        joined = rg.Curve.JoinCurves(crvs, step * 0.5) or crvs
        levels += 1

        for crv in joined:
            try:
                boundary = tread_outline(crv, plane)
            except:
                boundary = None
            if not boundary:
                off_fail += 1
                continue

            perimeter     = sum(c.GetLength() for c in boundary)
            expected_area = (perimeter / 2.0) * _depth

            planar = rg.Brep.CreatePlanarBreps(boundary, tol)
            if not planar:
                continue

            for pb in planar:
                if pb is None or not pb.IsValid:
                    continue
                ap = rg.AreaMassProperties.Compute(pb)
                if ap is None:
                    continue
                if ap.Area > expected_area * 2.5:
                    fat += 1
                    continue

                pb.Translate(rg.Vector3d(0, 0, -slab_h * 0.5))
                for face in pb.Faces:
                    s = rg.Brep.CreateFromOffsetFace(
                            face, slab_h, tol, False, True)
                    if s and s.IsValid:
                        slabs.append(s)
                        ok += 1
                        break

    log.append("levels={} slabs={} fat_rejected={} offset_fail={}".format(
        levels, ok, fat, off_fail))
    debug = "\n".join(log)
# ---------- end py3 ----------
geo_2 = Geometry(py3.slabs)
panel = Panel(py3.debug)
panel_2 = Panel(geo_2)

# ----
preview_2 = CustomPreview(Geometry=geo_2, Material=ColourSwatch(SwatchColor=RGB(204, 153, 80)))

# ---- group: grid box
geo_3 = Geometry(<brep referenced from the Rhino model>)
cap = CapHoles(Brep=geo)
py3_2 = Python3Script(bw=Slider(0.3, range=0..1), bh=Slider(0.3, range=0..1), loft=cap, brep=geo_3, grid_space=Slider(10, range=0..10))  # -> out, a, b; inputs bw: Double, bh: Double, loft: Brep, brep: Brep, grid_space: Int32
# ---------- py3_2: Python ----------
"""
Parametric Box with Grid Beams — GhPython Component
=====================================================
INPUTS:
  brep       : Brep  - Outer boundary (bounding box derived from it)
  loft       : Brep  - Closed lofted solid (grid trimmed at its surface)
  grid_space : float - Grid spacing in ft
  bw         : float - Beam cross-section width  (ft)
  bh         : float - Beam cross-section height (ft)

OUTPUTS:
  a : grid_lines — Trimmed grid lines (curves)
  b : beams      — Rectangular beam extrusions (Breps)
"""

import Rhino.Geometry as rg

tol = 0.001

# ================================================================
# GROUP 1 — DERIVE DIMENSIONS FROM BOUNDARY BREP
# ================================================================
bbox   = brep.GetBoundingBox(True)
min_pt = bbox.Min
max_pt = bbox.Max

L  = max_pt.X - min_pt.X
W  = max_pt.Y - min_pt.Y
H  = max_pt.Z - min_pt.Z
gs = grid_space
ox, oy, oz = min_pt.X, min_pt.Y, min_pt.Z


# ================================================================
# GROUP 3 — BUILD FULL GRID LINES
# ================================================================
def grid_vals(span, step):
    vals, v = [], 0.0
    while v <= span + 1e-6:
        vals.append(v)
        v += step
    return vals

xs = grid_vals(L, gs)
ys = grid_vals(W, gs)
zs = grid_vals(H, gs)

raw_lines = []
for yy in ys:
    for zz in zs:
        ln = rg.Line(rg.Point3d(ox,      oy + yy, oz + zz),
                     rg.Point3d(ox + L,  oy + yy, oz + zz))
        raw_lines.append(ln.ToNurbsCurve())
for xx in xs:
    for zz in zs:
        ln = rg.Line(rg.Point3d(ox + xx, oy,      oz + zz),
                     rg.Point3d(ox + xx, oy + W,  oz + zz))
        raw_lines.append(ln.ToNurbsCurve())
for xx in xs:
    for yy in ys:
        ln = rg.Line(rg.Point3d(ox + xx, oy + yy, oz),
                     rg.Point3d(ox + xx, oy + yy, oz + H))
        raw_lines.append(ln.ToNurbsCurve())

# ================================================================
# GROUP 4 — TRIM GRID LINES AGAINST LOFT SOLID
# ================================================================
loft_solid = loft.DuplicateBrep()

def trim_by_solid(curve, solid, tolerance, n_samples=200):
    dom = curve.Domain
    t0, t1 = float(dom.T0), float(dom.T1)
    ts = [t0 + (t1 - t0) * i / n_samples for i in range(n_samples + 1)]

    outside = []
    for t in ts:
        pt = curve.PointAt(t)
        try:
            outside.append(not solid.IsPointInside(pt, tolerance, False))
        except Exception:
            outside.append(True)

    result, seg_start = [], None
    for t, out in zip(ts, outside):
        if out and seg_start is None:
            seg_start = t
        elif not out and seg_start is not None:
            seg = curve.Trim(seg_start, t)
            if seg is not None:
                result.append(seg)
            seg_start = None
    if seg_start is not None:
        seg = curve.Trim(seg_start, t1)
        if seg is not None:
            result.append(seg)
    return result

trimmed = []
for crv in raw_lines:
    trimmed.extend(trim_by_solid(crv, loft_solid, tol))

# ================================================================
# GROUP 5 — EXTRUDE EACH SEGMENT INTO A RECTANGULAR BEAM
#
# Cross-section orientation:
#   horizontal beams → width perpendicular in XY plane, height in Z
#   vertical columns → width in X, height in Y
#
# Method: build a Box whose plane X-axis runs along the beam,
#         Y-axis is the horizontal-perpendicular (ax),
#         Z-axis (normal) = d × ax.
#         Origin is offset by -ax*(bw/2) - normal*(bh/2)
#         so the cross-section is centred on the line.
# ================================================================
def make_beam(crv, width, height):
    s = crv.PointAtStart
    e = crv.PointAtEnd
    d = e - s
    span = d.Length
    if span < 1e-6:
        return None
    d.Unitize()

    if abs(d.Z) > 0.9:               # vertical column
        ax = rg.Vector3d.XAxis
    else:                             # horizontal beam
        ax = rg.Vector3d.CrossProduct(rg.Vector3d.ZAxis, d)
        ax.Unitize()

    normal = rg.Vector3d.CrossProduct(d, ax)
    normal.Unitize()

    origin = s - ax * (width * 0.5) - normal * (height * 0.5)
    plane  = rg.Plane(origin, d, ax)
    box    = rg.Box(plane,
                    rg.Interval(0, span),
                    rg.Interval(0, width),
                    rg.Interval(0, height))
    return box.ToBrep() if box.IsValid else None

beams = []
for seg in trimmed:
    b_geo = make_beam(seg, bw, bh)
    if b_geo is not None:
        beams.append(b_geo)

# ================================================================
# GROUP 6 — OUTPUTS
# ================================================================
a = trimmed    # trimmed grid lines (curves)
b = beams      # rectangular beam extrusions (Breps)
# ---------- end py3_2 ----------
crv_2 = Curve(py3_2.a)

# ----
brep = Brep(py3_2.b)

# ---- group: grid box (continued)
preview_3 = CustomPreview(Geometry=brep, Material=ColourSwatch(SwatchColor=RGB(255, 255, 255)))
