# Grasshopper definition contour.gh (Grasshopper 0.9.76)

brep = Brep(<brep referenced from the Rhino model>)
contour = Contour(Shape=brep, Point=Point(0, 0, 0), Direction=Vector(0, 0, 1), Distance=Slider(0.5, range=0..1))
Z = UnitZ(Factor=Slider(0.4, range=0..1))
move = Move(Geometry=contour, Motion=Z)  # -> Geometry, Transform
number_slider = Slider(0.45, range=0..1)
crv = Curve(move.Geometry)
extr = Extrude(Base=crv, Direction=Z)
loft = Loft(Curves=move.Geometry, Options={Adjust=False, Closed=False, LoftEnds=0, LoftSimp=0, LoftType=0, Rebuild=10, Refit=0.01})
pipe = Pipe(Curve=contour, Radius=Slider(0.015, range=0..0.1), Caps=0)
