# Grasshopper definition roof_diagrid.gh (Grasshopper 0.9.76)
# plug-ins: BullAnt, LunchBox

number_slider = Slider(10, range=0..10)
number_slider_2 = Slider(20, range=0..100)
number_slider_3 = Slider(20, range=0..100)
number_slider_4 = Slider(20, range=0..100)
number_slider_5 = Slider(20, range=0..100)
srf = Surface(<surface referenced from the Rhino model>)
srf_2 = Surface(<surface referenced from the Rhino model>)
srf_3 = Surface(<surface referenced from the Rhino model>)
srf_4 = Surface(<surface referenced from the Rhino model>)
srf_5 = Surface(<surface referenced from the Rhino model>)
srf_6 = Surface(<surface referenced from the Rhino model>)
srf_7 = Surface(<surface referenced from the Rhino model>)
srf_8 = Surface(<surface referenced from the Rhino model>)
srf_9 = Surface([<surface referenced from the Rhino model> x2])
srf_10 = Surface([<surface referenced from the Rhino model> x2])
srf_11 = Surface(<surface referenced from the Rhino model>)
srf_12 = Surface(<surface referenced from the Rhino model>)
srf_13 = Surface(<surface referenced from the Rhino model>)
srf_14 = Surface(<surface referenced from the Rhino model>)
diamond = DiamondPanels(Surface=srf_4, UDivisions=Slider(20, range=0..100), VDivisions=number_slider)  # -> DiamondPanels, TriPanels
diamond_2 = DiamondPanels(Surface=srf_2, UDivisions=Slider(20, range=0..100), VDivisions=number_slider)  # -> DiamondPanels, TriPanels
diamond_3 = DiamondPanels(Surface=srf, UDivisions=Slider(20, range=0..100), VDivisions=number_slider)  # -> DiamondPanels, TriPanels
diamond_4 = DiamondPanels(Surface=srf_3, UDivisions=Slider(20, range=0..100), VDivisions=number_slider)  # -> DiamondPanels, TriPanels
diamond_5 = DiamondPanels(Surface=srf_5, UDivisions=Slider(10, range=0..10), VDivisions=Slider(20, range=0..100))  # -> DiamondPanels, TriPanels
diamond_6 = DiamondPanels(Surface=srf_6, UDivisions=Slider(20, range=0..100), VDivisions=Slider(10, range=0..10))  # -> DiamondPanels, TriPanels
diamond_7 = DiamondPanels(Surface=srf_7, UDivisions=Slider(10, range=0..10), VDivisions=Slider(20, range=0..100))  # -> DiamondPanels, TriPanels
diamond_8 = DiamondPanels(Surface=srf_8, UDivisions=number_slider_2, VDivisions=number_slider_2)  # -> DiamondPanels, TriPanels
diamond_9 = DiamondPanels(Surface=srf_11, UDivisions=number_slider, VDivisions=Slider(20, range=0..100))  # -> DiamondPanels, TriPanels
diamond_10 = DiamondPanels(Surface=srf_10, UDivisions=Slider(5, range=0..10), VDivisions=Slider(20, range=0..100))  # -> DiamondPanels, TriPanels
diamond_11 = DiamondPanels(Surface=srf_12, UDivisions=number_slider_3, VDivisions=number_slider_3)  # -> DiamondPanels, TriPanels
diamond_12 = DiamondPanels(Surface=srf_13, UDivisions=number_slider_4, VDivisions=number_slider_4)  # -> DiamondPanels, TriPanels
diamond_13 = DiamondPanels(Surface=srf_9, UDivisions=Slider(20, range=0..100), VDivisions=Slider(5, range=0..10))  # -> DiamondPanels, TriPanels
diamond_14 = DiamondPanels(Surface=srf_14, UDivisions=number_slider_5, VDivisions=number_slider_5)  # -> DiamondPanels, TriPanels
srf_15 = Surface(diamond_2.TriPanels)
srf_16 = Surface(diamond_11.TriPanels)
srf_17 = Surface(diamond_14.TriPanels)
srf_18 = Surface(diamond_4.TriPanels)
srf_19 = Surface(diamond_3.TriPanels)
srf_20 = Surface(diamond_9.DiamondPanels)
srf_21 = Surface(diamond_9.TriPanels)
srf_22 = Surface(diamond_11.DiamondPanels)
crv = Curve(<curve referenced from the Rhino model>)
srf_23 = Surface(diamond_3.DiamondPanels)  # disabled
srf_24 = Surface(diamond_4.DiamondPanels)
crv_2 = Curve(<curve referenced from the Rhino model>)
srf_25 = Surface(diamond.DiamondPanels)
srf_26 = Surface(diamond_6.TriPanels)
srf_27 = Surface(diamond_8.DiamondPanels)
srf_28 = Surface(diamond_12.DiamondPanels)
srf_29 = Surface(srf_20)
srf_30 = Surface(diamond_14.DiamondPanels)
srf_31 = Surface(diamond_2.DiamondPanels)
srf_32 = Surface([diamond_3.DiamondPanels, diamond_9.DiamondPanels, diamond_11.DiamondPanels, diamond_14.DiamondPanels, diamond_2.DiamondPanels, diamond_12.DiamondPanels, diamond_8.DiamondPanels, diamond.DiamondPanels, diamond_4.DiamondPanels, diamond_7.DiamondPanels, diamond_6.DiamondPanels, diamond_5.DiamondPanels, diamond_10.DiamondPanels, diamond_13.DiamondPanels])
srf_33 = Surface(srf_24)
srf_34 = Surface(srf_26)
debrep = DeconstructBrep(Brep=srf_32)  # -> Faces, Edges, Vertices
srf_35 = Surface(diamond_5.DiamondPanels)
area = Area(Geometry=srf_23)  # -> Area, Centroid; disabled
srf_36 = Surface(diamond_10.DiamondPanels)
srf_37 = Surface(diamond_7.DiamondPanels)
area_2 = Area(Geometry=srf_29)  # -> Area, Centroid
srf_38 = Surface(diamond_6.DiamondPanels)
crv_3 = Curve(flatten(debrep.Edges))
crv_cp = CurveClosestPoint(Point=area.Centroid, Curve=crv)  # -> Point, Parameter, Distance; disabled
crv_4 = Curve(<curve referenced from the Rhino model>)
crv_5 = Curve(<curve referenced from the Rhino model>)
panel = Panel("0.3 to 1.0")  # disabled
crv_6 = Curve(<curve referenced from the Rhino model>)
crv_cp_2 = CurveClosestPoint(Point=area_2.Centroid, Curve=crv_2)  # -> Point, Parameter, Distance
srf_39 = Surface(srf_30)
srf_40 = Surface(srf_31)
bnd = Bounds(Numbers=crv_cp.Distance)  # disabled
srf_41 = Surface(srf_22)
srf_42 = Surface(srf_28)
bnd_2 = Bounds(Numbers=crv_cp_2.Distance)
crv_7 = Curve(<curve referenced from the Rhino model>)
remap = RemapNumbers(Value=crv_cp.Distance, Source=bnd, Target=panel)  # -> reverse(Mapped), Clipped; disabled
area_3 = Area(Geometry=srf_39)  # -> Area, Centroid
area_4 = Area(Geometry=srf_40)  # -> Area, Centroid
area_5 = Area(Geometry=srf_42)  # -> Area, Centroid
area_6 = Area(Geometry=srf_41)  # -> Area, Centroid
srf_43 = Surface(srf_25)
srf_44 = Surface(srf_27)
remap_2 = RemapNumbers(Value=crv_cp_2.Distance, Source=bnd_2, Target="0.3 to 1.0")  # -> reverse(Mapped), Clipped
crv_8 = Curve(<curve referenced from the Rhino model>)
crv_cp_3 = CurveClosestPoint(Point=area_3.Centroid, Curve=crv_4)  # -> Point, Parameter, Distance
graph = GraphMapper(remap.Mapped, x0=0, x1=1, y0=0, y1=1, container_name="Bezier", cpx=[0, 0.5864637494, 0.6501184702, 1], cpy=[0, 0, 1, 1])  # disabled
crv_cp_4 = CurveClosestPoint(Point=area_4.Centroid, Curve=crv_6)  # -> Point, Parameter, Distance
crv_cp_5 = CurveClosestPoint(Point=area_5.Centroid, Curve=crv_5)  # -> Point, Parameter, Distance
crv_cp_6 = CurveClosestPoint(Point=area_6.Centroid, Curve=crv)  # -> Point, Parameter, Distance
graph_2 = GraphMapper(
    remap_2.Mapped,
    x0=0,
    x1=1,
    y0=0,
    y1=1,
    container_name="Bezier",
    cpx=[0, 0.1195728183, 0.5867391825, 1],
    cpy=[0, 0, 1, 1])
srf_45 = Surface(srf_33)
srf_46 = Surface(diamond_13.DiamondPanels)
crv_9 = Curve(<curve referenced from the Rhino model>)
crv_10 = Curve(<curve referenced from the Rhino model>)
srf_47 = Surface(srf_34)
crv_11 = Curve(<curve referenced from the Rhino model>)
srf_48 = Surface(srf_35)
bnd_3 = Bounds(Numbers=crv_cp_3.Distance)
crv_12 = Curve(<curve referenced from the Rhino model>)
bnd_4 = Bounds(Numbers=crv_cp_4.Distance)
bnd_5 = Bounds(Numbers=crv_cp_5.Distance)
bnd_6 = Bounds(Numbers=crv_cp_6.Distance)
srf_49 = Surface(srf_36)
area_7 = Area(Geometry=srf_43)  # -> Area, Centroid
crv_13 = Curve(<curve referenced from the Rhino model>)
area_8 = Area(Geometry=srf_44)  # -> Area, Centroid
srf_50 = Surface(srf_37)
crv_14 = Curve(<curve referenced from the Rhino model>)
srf_51 = Surface(srf_38)
crv_15 = Curve(<curve referenced from the Rhino model>)
scale = Scale(Geometry=srf_23, Center=area.Centroid, Factor=graph)  # -> graft(Geometry), Transform; disabled
crv_cp_7 = CurveClosestPoint(Point=area_7.Centroid, Curve=crv_8)  # -> Point, Parameter, Distance
crv_cp_8 = CurveClosestPoint(Point=area_8.Centroid, Curve=crv_7)  # -> Point, Parameter, Distance
scale_2 = Scale(Geometry=srf_29, Center=area_2.Centroid, Factor=graph_2)  # -> graft(Geometry), Transform
area_9 = Area(Geometry=srf_45)  # -> Area, Centroid
area_10 = Area(Geometry=srf_46)  # -> Area, Centroid
remap_3 = RemapNumbers(Value=crv_cp_3.Distance, Source=bnd_3, Target="0.3 to 1.0")  # -> reverse(Mapped), Clipped
remap_4 = RemapNumbers(Value=crv_cp_4.Distance, Source=bnd_4, Target="0.3 to 1.0")  # -> reverse(Mapped), Clipped
area_11 = Area(Geometry=srf_47)  # -> Area, Centroid
remap_5 = RemapNumbers(Value=crv_cp_5.Distance, Source=bnd_5, Target="0.3 to 1.0")  # -> reverse(Mapped), Clipped
remap_6 = RemapNumbers(Value=crv_cp_6.Distance, Source=bnd_6, Target="0.3 to 1.0")  # -> reverse(Mapped), Clipped
area_12 = Area(Geometry=srf_48)  # -> Area, Centroid
debrep_2 = DeconstructBrep(Brep=scale.Geometry)  # -> Faces, Edges, Vertices; disabled
debrep_3 = DeconstructBrep(Brep=srf_23)  # -> Faces, Edges, Vertices; disabled
area_13 = Area(Geometry=srf_49)  # -> Area, Centroid
bnd_7 = Bounds(Numbers=crv_cp_7.Distance)
bnd_8 = Bounds(Numbers=crv_cp_8.Distance)
area_14 = Area(Geometry=srf_50)  # -> Area, Centroid
crv_cp_9 = CurveClosestPoint(Point=area_9.Centroid, Curve=crv_9)  # -> Point, Parameter, Distance
crv_cp_10 = CurveClosestPoint(Point=area_10.Centroid, Curve=crv_10)  # -> Point, Parameter, Distance
debrep_4 = DeconstructBrep(Brep=scale_2.Geometry)  # -> Faces, Edges, Vertices
debrep_5 = DeconstructBrep(Brep=srf_29)  # -> Faces, Edges, Vertices
area_15 = Area(Geometry=srf_51)  # -> Area, Centroid
crv_cp_11 = CurveClosestPoint(Point=area_11.Centroid, Curve=crv_11)  # -> Point, Parameter, Distance
graph_3 = GraphMapper(remap_3.Mapped, x0=0, x1=1, y0=0, y1=1, container_name="Bezier", cpx=[0, 0.225770697, 0.6501184702, 1], cpy=[0, 0, 1, 1])
graph_4 = GraphMapper(
    remap_4.Mapped,
    x0=0,
    x1=1,
    y0=0,
    y1=1,
    container_name="Bezier",
    cpx=[0, 0.1760336459, 0.5183798075, 1],
    cpy=[0, 0, 0.8882579207, 1])
crv_cp_12 = CurveClosestPoint(Point=area_12.Centroid, Curve=crv_12)  # -> Point, Parameter, Distance
graph_5 = GraphMapper(remap_6.Mapped, x0=0, x1=1, y0=0, y1=1, container_name="Bezier", cpx=[0, 0.225770697, 0.6501184702, 1], cpy=[0, 0, 1, 1])
graph_6 = GraphMapper(remap_5.Mapped, x0=0, x1=1, y0=0, y1=1, container_name="Bezier", cpx=[0, 0.225770697, 0.6501184702, 1], cpy=[0, 0, 1, 1])
crv_cp_13 = CurveClosestPoint(Point=area_13.Centroid, Curve=crv_13)  # -> Point, Parameter, Distance
crv_cp_14 = CurveClosestPoint(Point=area_14.Centroid, Curve=crv_14)  # -> Point, Parameter, Distance
join = JoinCurves(Curves=[debrep_3.Edges, debrep_2.Edges], Preserve=False)  # disabled
bnd_9 = Bounds(Numbers=crv_cp_9.Distance)
bnd_10 = Bounds(Numbers=crv_cp_10.Distance)
debrep_6 = DeconstructBrep(Brep=srf_39)  # -> Faces, Edges, Vertices
panel_2 = Panel("0.3 to 1.0")
crv_cp_15 = CurveClosestPoint(Point=area_15.Centroid, Curve=crv_15)  # -> Point, Parameter, Distance
bnd_11 = Bounds(Numbers=crv_cp_11.Distance)
debrep_7 = DeconstructBrep(Brep=srf_42)  # -> Faces, Edges, Vertices
debrep_8 = DeconstructBrep(Brep=srf_41)  # -> Faces, Edges, Vertices
bnd_12 = Bounds(Numbers=crv_cp_12.Distance)
remap_7 = RemapNumbers(Value=crv_cp_7.Distance, Source=bnd_7, Target="0.3 to 1.0")  # -> reverse(Mapped), Clipped
remap_8 = RemapNumbers(Value=crv_cp_8.Distance, Source=bnd_8, Target="0.3 to 1.0")  # -> reverse(Mapped), Clipped
join_2 = JoinCurves(Curves=[debrep_5.Edges, debrep_4.Edges], Preserve=False)
bnd_13 = Bounds(Numbers=crv_cp_13.Distance)
bnd_14 = Bounds(Numbers=crv_cp_14.Distance)
scale_3 = Scale(Geometry=srf_39, Center=area_3.Centroid, Factor=graph_3)  # -> graft(Geometry), Transform
scale_4 = Scale(Geometry=srf_40, Center=area_4.Centroid, Factor=graph_4)  # -> graft(Geometry), Transform
bnd_15 = Bounds(Numbers=crv_cp_15.Distance)
scale_5 = Scale(Geometry=srf_42, Center=area_5.Centroid, Factor=graph_6)  # -> graft(Geometry), Transform
scale_6 = Scale(Geometry=srf_41, Center=area_6.Centroid, Factor=graph_5)  # -> graft(Geometry), Transform
loft = Loft(Curves=join, Options={Adjust=False, Closed=False, LoftEnds=0, LoftSimp=0, LoftType=0, Rebuild=10, Refit=0.01})  # disabled
graph_7 = GraphMapper(remap_8.Mapped, x0=0, x1=1, y0=0, y1=1, container_name="Bezier", cpx=[0, 0.225770697, 0.6501184702, 1], cpy=[0, 0, 1, 1])
remap_9 = RemapNumbers(Value=crv_cp_9.Distance, Source=bnd_9, Target="0.3 to 1.0")  # -> reverse(Mapped), Clipped
remap_10 = RemapNumbers(Value=crv_cp_10.Distance, Source=bnd_10, Target="0.3 to 1.0")  # -> reverse(Mapped), Clipped
remap_11 = RemapNumbers(Value=crv_cp_11.Distance, Source=bnd_11, Target="0.3 to 1.0")  # -> reverse(Mapped), Clipped
remap_12 = RemapNumbers(Value=crv_cp_12.Distance, Source=bnd_12, Target="0.3 to 1.0")  # -> reverse(Mapped), Clipped
graph_8 = GraphMapper(
    remap_7.Mapped,
    x0=0,
    x1=1,
    y0=0,
    y1=1,
    container_name="Bezier",
    cpx=[0, 0.5864637494, 0.6501184702, 1],
    cpy=[0, 0, 1, 1])
loft_2 = Loft(Curves=join_2, Options={Adjust=False, Closed=False, LoftEnds=0, LoftSimp=0, LoftType=0, Rebuild=10, Refit=0.01})
remap_13 = RemapNumbers(Value=crv_cp_13.Distance, Source=bnd_13, Target="0.3 to 1.0")  # -> reverse(Mapped), Clipped
debrep_9 = DeconstructBrep(Brep=scale_3.Geometry)  # -> Faces, Edges, Vertices
debrep_10 = DeconstructBrep(Brep=scale_4.Geometry)  # -> Faces, Edges, Vertices
debrep_11 = DeconstructBrep(Brep=srf_40)  # -> Faces, Edges, Vertices
debrep_12 = DeconstructBrep(Brep=srf_43)  # -> Faces, Edges, Vertices
debrep_13 = DeconstructBrep(Brep=srf_44)  # -> Faces, Edges, Vertices
debrep_14 = DeconstructBrep(Brep=scale_5.Geometry)  # -> Faces, Edges, Vertices
debrep_15 = DeconstructBrep(Brep=scale_6.Geometry)  # -> Faces, Edges, Vertices
remap_14 = RemapNumbers(Value=crv_cp_14.Distance, Source=bnd_14, Target="0.3 to 1.0")  # -> reverse(Mapped), Clipped
remap_15 = RemapNumbers(Value=crv_cp_15.Distance, Source=bnd_15, Target="0.3 to 1.0")  # -> reverse(Mapped), Clipped
graph_9 = GraphMapper(
    remap_9.Mapped,
    x0=0,
    x1=1,
    y0=0,
    y1=1,
    container_name="Bezier",
    cpx=[0, 0.5864637494, 0.3810813129, 1],
    cpy=[0, 0, 0.9886845946, 1])
graph_10 = GraphMapper(
    remap_10.Mapped,
    x0=0,
    x1=1,
    y0=0,
    y1=1,
    container_name="Bezier",
    cpx=[0, 0.2877209485, 0.7050337195, 1],
    cpy=[0, 0, 0.9032990932, 0.6814283133])
scale_7 = Scale(Geometry=srf_43, Center=area_7.Centroid, Factor=graph_8)  # -> graft(Geometry), Transform
scale_8 = Scale(Geometry=srf_44, Center=area_8.Centroid, Factor=graph_7)  # -> graft(Geometry), Transform
graph_11 = GraphMapper(remap_11.Mapped, x0=0, x1=1, y0=0, y1=1, container_name="Bezier", cpx=[0, 0.5864637494, 0, 1], cpy=[0, 0, 1, 1])
graph_12 = GraphMapper(
    remap_12.Mapped,
    x0=0,
    x1=1,
    y0=0,
    y1=1,
    container_name="Bezier",
    cpx=[0, 0.788875103, 0.8186602592, 1],
    cpy=[0, 0, 1, 1])
debrep_16 = DeconstructBrep(Brep=srf_45)  # -> Faces, Edges, Vertices
debrep_17 = DeconstructBrep(Brep=srf_46)  # -> Faces, Edges, Vertices
join_3 = JoinCurves(Curves=[debrep_6.Edges, debrep_9.Edges], Preserve=False)
join_4 = JoinCurves(Curves=[debrep_11.Edges, debrep_10.Edges], Preserve=False)
debrep_18 = DeconstructBrep(Brep=srf_47)  # -> Faces, Edges, Vertices
graph_13 = GraphMapper(
    remap_13.Mapped,
    x0=0,
    x1=1,
    y0=0,
    y1=1,
    container_name="Bezier",
    cpx=[0, 0.788875103, 0.8186602592, 1],
    cpy=[0, 0, 1, 1])
debrep_19 = DeconstructBrep(Brep=srf_48)  # -> Faces, Edges, Vertices
join_5 = JoinCurves(Curves=[debrep_7.Edges, debrep_14.Edges], Preserve=False)
join_6 = JoinCurves(Curves=[debrep_8.Edges, debrep_15.Edges], Preserve=False)
graph_14 = GraphMapper(
    remap_14.Mapped,
    x0=0,
    x1=1,
    y0=0,
    y1=1,
    container_name="Bezier",
    cpx=[0, 0.5864637494, 0.6960769892, 1],
    cpy=[0, 0, 1, 1])
debrep_20 = DeconstructBrep(Brep=srf_49)  # -> Faces, Edges, Vertices
graph_15 = GraphMapper(
    remap_15.Mapped,
    x0=0,
    x1=1,
    y0=0,
    y1=1,
    container_name="Bezier",
    cpx=[0, 0.9537858963, 0, 1],
    cpy=[0, 0, 1, 0.7108384371])
debrep_21 = DeconstructBrep(Brep=srf_50)  # -> Faces, Edges, Vertices
scale_9 = Scale(Geometry=srf_45, Center=area_9.Centroid, Factor=graph_9)  # -> graft(Geometry), Transform
debrep_22 = DeconstructBrep(Brep=scale_7.Geometry)  # -> Faces, Edges, Vertices
scale_10 = Scale(Geometry=srf_46, Center=area_10.Centroid, Factor=graph_10)  # -> graft(Geometry), Transform
debrep_23 = DeconstructBrep(Brep=scale_8.Geometry)  # -> Faces, Edges, Vertices
debrep_24 = DeconstructBrep(Brep=srf_51)  # -> Faces, Edges, Vertices
scale_11 = Scale(Geometry=srf_47, Center=area_11.Centroid, Factor=graph_11)  # -> graft(Geometry), Transform
scale_12 = Scale(Geometry=srf_48, Center=area_12.Centroid, Factor=graph_12)  # -> graft(Geometry), Transform
scale_13 = Scale(Geometry=srf_49, Center=area_13.Centroid, Factor=graph_13)  # -> graft(Geometry), Transform
loft_3 = Loft(Curves=join_3, Options={Adjust=False, Closed=False, LoftEnds=0, LoftSimp=0, LoftType=0, Rebuild=10, Refit=0.01})
loft_4 = Loft(Curves=join_4, Options={Adjust=False, Closed=False, LoftEnds=0, LoftSimp=0, LoftType=0, Rebuild=10, Refit=0.01})
scale_14 = Scale(Geometry=srf_50, Center=area_14.Centroid, Factor=graph_14)  # -> graft(Geometry), Transform
loft_5 = Loft(Curves=join_5, Options={Adjust=False, Closed=False, LoftEnds=0, LoftSimp=0, LoftType=0, Rebuild=10, Refit=0.01})
loft_6 = Loft(Curves=join_6, Options={Adjust=False, Closed=False, LoftEnds=0, LoftSimp=0, LoftType=0, Rebuild=10, Refit=0.01})
scale_15 = Scale(Geometry=srf_51, Center=area_15.Centroid, Factor=graph_15)  # -> graft(Geometry), Transform
debrep_25 = DeconstructBrep(Brep=scale_9.Geometry)  # -> Faces, Edges, Vertices
debrep_26 = DeconstructBrep(Brep=scale_10.Geometry)  # -> Faces, Edges, Vertices
join_7 = JoinCurves(Curves=[debrep_12.Edges, debrep_22.Edges], Preserve=False)
debrep_27 = DeconstructBrep(Brep=scale_11.Geometry)  # -> Faces, Edges, Vertices
join_8 = JoinCurves(Curves=[debrep_13.Edges, debrep_23.Edges], Preserve=False)
debrep_28 = DeconstructBrep(Brep=scale_12.Geometry)  # -> Faces, Edges, Vertices
debrep_29 = DeconstructBrep(Brep=scale_13.Geometry)  # -> Faces, Edges, Vertices
debrep_30 = DeconstructBrep(Brep=scale_14.Geometry)  # -> Faces, Edges, Vertices
debrep_31 = DeconstructBrep(Brep=scale_15.Geometry)  # -> Faces, Edges, Vertices
join_9 = JoinCurves(Curves=[debrep_16.Edges, debrep_25.Edges], Preserve=False)
join_10 = JoinCurves(Curves=[debrep_17.Edges, debrep_26.Edges], Preserve=False)
join_11 = JoinCurves(Curves=[debrep_18.Edges, debrep_27.Edges], Preserve=False)
join_12 = JoinCurves(Curves=[debrep_19.Edges, debrep_28.Edges], Preserve=False)
loft_7 = Loft(Curves=join_7, Options={Adjust=False, Closed=False, LoftEnds=0, LoftSimp=0, LoftType=0, Rebuild=10, Refit=0.01})
loft_8 = Loft(Curves=join_8, Options={Adjust=False, Closed=False, LoftEnds=0, LoftSimp=0, LoftType=0, Rebuild=10, Refit=0.01})
join_13 = JoinCurves(Curves=[debrep_20.Edges, debrep_29.Edges], Preserve=False)
join_14 = JoinCurves(Curves=[debrep_21.Edges, debrep_30.Edges], Preserve=False)
join_15 = JoinCurves(Curves=[debrep_24.Edges, debrep_31.Edges], Preserve=False)
loft_9 = Loft(Curves=join_9, Options={Adjust=False, Closed=False, LoftEnds=0, LoftSimp=0, LoftType=0, Rebuild=10, Refit=0.01})
loft_10 = Loft(Curves=join_10, Options={Adjust=False, Closed=False, LoftEnds=0, LoftSimp=0, LoftType=0, Rebuild=10, Refit=0.01})
loft_11 = Loft(Curves=join_11, Options={Adjust=False, Closed=False, LoftEnds=0, LoftSimp=0, LoftType=0, Rebuild=10, Refit=0.01})
loft_12 = Loft(Curves=join_12, Options={Adjust=False, Closed=False, LoftEnds=0, LoftSimp=0, LoftType=0, Rebuild=10, Refit=0.01})
loft_13 = Loft(Curves=join_13, Options={Adjust=False, Closed=False, LoftEnds=0, LoftSimp=0, LoftType=0, Rebuild=10, Refit=0.01})
loft_14 = Loft(Curves=join_14, Options={Adjust=False, Closed=False, LoftEnds=0, LoftSimp=0, LoftType=0, Rebuild=10, Refit=0.01})
loft_15 = Loft(Curves=join_15, Options={Adjust=False, Closed=False, LoftEnds=0, LoftSimp=0, LoftType=0, Rebuild=10, Refit=0.01})
ggrd = GgRemoveDuplicates(Curves=crv_3, Tol=1e-07)
