# Grasshopper definition offset_fillet.gh (Grasshopper 0.9.76)
# plug-ins: BullAnt

number_slider = Slider(1, range=0..10)
crv = Curve([<curve referenced from the Rhino model> x189])
multiplication = Multiplication(A=number_slider, B=-1)
ggcnp = GgNetworkPolygons(PerimOrVoid=10)
offset = Offset(Curve=crv, Distance=multiplication, Plane=PlaneXY(0, 0, 0), Corners=1)
offset_2 = Offset(Curve=crv, Distance=number_slider, Plane=PlaneXY(0, 0, 0), Corners=1)
graft = GraftTree(Tree=offset_2, IncludeEmptyLists=True, IncludeNullItems=True)
graft_2 = GraftTree(Tree=offset, IncludeEmptyLists=True, IncludeNullItems=True)
end = EndPoints(Curve=graft)  # -> Start, End
end_2 = EndPoints(Curve=graft_2)  # -> Start, End
ln = Line(StartPoint=end.Start, EndPoint=end_2.Start)
ln_2 = Line(StartPoint=end.End, EndPoint=end_2.End)
crv_2 = Curve([graft, ln, ln_2, graft_2])
join = JoinCurves(Curves=crv_2, Preserve=False)
flatten = FlattenTree(Tree=join, Path="{0}")
runion = RegionUnion(Curves=flatten)
crv_3 = Curve([<curve referenced from the Rhino model> x3])
crv_4 = Curve(runion)
crv_5 = Curve([<curve referenced from the Rhino model> x21])
crv_6 = Curve([<curve referenced from the Rhino model> x79])
rdiff = RegionDifference(CurvesA=runion, CurvesB=crv_3)
crv_7 = Curve([crv_5, crv_6])
fillet = Fillet(Curve=rdiff, Radius=Slider(0.5, range=0..1))
runion_2 = RegionUnion(Curves=crv_7)
