# Grasshopper definition perforation.gh (Grasshopper 0.9.76)

number_slider = Slider(68, range=0..100)
crv = Curve(reparameterize(<curve referenced from the Rhino model>))
divlength = DivideLength(Curve=crv, Length=Slider(1.89, range=0..10))  # -> Points, Tangents, Parameters
range = Range(Domain=Domain(0, 1), Steps=number_slider)
graph = GraphMapper(
    range,
    x0=0,
    x1=1,
    y0=0,
    y1=1,
    container_name="Bezier",
    cpx=[0, 0.7850992084, 0.1653566211, 1],
    cpy=[0, 0.1380756497, 0.7554436326, 1])
divide = DivideCurve(Curve=crv, Count=number_slider, Kinks=False)  # -> Points, Tangents, Parameters
remap = RemapNumbers(Value=graph, Source=Domain(0, 1), Target=Domain(0, 1))  # -> Mapped, Clipped
item = ListItem(List=divide.Points, Index=0, Wrap=True)  # -> Item, Item1
dist = Distance(PointA=item.Item, PointB=item.Item1)
panel = Panel(range)
len = Length()
crv_2 = Curve(reparameterize([<curve referenced from the Rhino model> x8]))
number_slider_2 = Slider(-3.45, range=-9..10)
eval = EvaluateCurve(Curve=crv, Parameter=panel)  # -> Point, Tangent, Angle
rotate = Rotate(Geometry=eval.Tangent, Angle=1.570796327, Plane=PlaneXY(0, 0, 0))  # -> Geometry, Transform
line = LineSDL(Start=eval.Point, Direction=rotate.Geometry, Length=Slider(10, range=0..10))
curvepoint = PointOnCurve(line, parameter=0.551)
multiplication = Multiplication(A=number_slider_2, B=-1)
line_2 = LineSDL(Start=eval.Point, Direction=Vector(0, 0, 1), Length=1)
offset = Offset(Curve=crv_2, Distance=graft([number_slider_2, multiplication]), Plane=PlaneXY(0, 0, 0), Corners=1)  # -> flatten(Curve)
number_slider_3 = Slider(0.854, range=0..10)
panel_2 = Panel(".854")
len_2 = Length(Curve=offset)
scale = Scale(Geometry=line, Center=curvepoint, Factor=Slider(24, range=0..1000))  # -> Geometry, Transform
division = Division(A=Slider(0.7, range=0..1.3), B="1.477")
sort = SortList(Keys=len_2, ValuesA=offset)  # -> Keys, ValuesA
item_2 = ListItem(List=flatten(sort.ValuesA), Index=0, Wrap=True)  # -> Item, Item1, Item2, Item3, Item4, Item5, Item6, Item7
ccx = CurveCurve(
    CurveA=scale.Geometry,
    CurveB=graft([item_2.Item, item_2.Item1, item_2.Item2, item_2.Item3, item_2.Item4, item_2.Item5, item_2.Item6, item_2.Item7]))  # -> Points, ParamsA, ParamsB
panel_3 = Panel(division)
item_3 = ListItem(List=ccx.Points, Index=0, Wrap=True)  # -> Item, Item1, Item2, Item3
ln = Line(StartPoint=item_3.Item2, EndPoint=item_3.Item3)  # -> graft(Line)
ln_2 = Line(StartPoint=item_3.Item, EndPoint=item_3.Item1)  # -> graft(Line)
pt = Point(item_3.Item1)
multiplication_2 = Multiplication(A=panel_3, B=-1)
offset_2 = Offset(Curve=ln_2, Distance=multiplication_2, Plane=PlaneXY(0, 0, 0), Corners=1)
offset_3 = Offset(Curve=ln_2, Distance=panel_3, Plane=PlaneXY(0, 0, 0), Corners=1)
item_4 = ListItem(List=offset_2, Index=0, Wrap=True)  # -> Item, Item1
end = EndPoints(Curve=offset_3)  # -> Start, End
end_2 = EndPoints(Curve=offset_2)  # -> Start, End
ln_3 = Line(StartPoint=end_2.Start, EndPoint=end.Start)
ln_4 = Line(StartPoint=end_2.End, EndPoint=end.End)
panel_4 = Panel(offset_2)
len_3 = Length(Curve=ln_3)
join = JoinCurves(Curves=flatten([offset_2, offset_3, ln_3, ln_4]), Preserve=False)
division_2 = Division(A=len_3, B=2)  # -> flatten(Result)
panel_5 = Panel(division_2)
fillet = FilletDistance(Curve=join, Distance=division_2)
pt_2 = Point(<point referenced from the Rhino model>)
area = Area(Geometry=fillet)  # -> Area, Centroid
dist_2 = Distance(PointA=area.Centroid, PointB=pt_2)
sort_2 = SortList(Keys=dist_2, ValuesA=fillet)  # -> Keys, ValuesA
cull = CullPattern(List=sort_2.ValuesA, CullPattern=[False, True, True])
cull_2 = CullPattern(List=sort_2.ValuesA, CullPattern=[False, True])
cull_3 = CullPattern(List=sort_2.ValuesA, CullPattern=[False, True, False])
cull_4 = CullPattern(List=sort_2.ValuesA, CullPattern=[False, True, False, False])
cull_5 = CullPattern(List=sort_2.ValuesA, CullPattern=[False, True, False, False])
cull_6 = CullPattern(List=sort_2.ValuesA, CullPattern=[False, True, True, True])
