# Grasshopper definition ramp_with_landing.gh (Grasshopper 1.0.7)

rhino_project_units = ValueList({"Millimeters", "Centimeters", "Meters", "Inches", "Feet"}, selected="Feet")

# ----
# Project Subtitle
sliders_and_editable_parameters = Panel("")
# Project Title
geometry_inputs = Panel("")

landing_length = Slider(38, range=0..50)
amount_of_ramp = Slider(3, range=0..10)
landing_depth = Slider(21745, range=0..500000)
crv = Curve(<curve referenced from the Rhino model>)
len = Length(Curve=crv)
subtraction = Subtraction(A=amount_of_ramp, B="1")
multiplication = Multiplication(A=subtraction, B=landing_depth)
# total ramp length
subtraction_2 = Subtraction(A=len, B=multiplication)
height = Slider(10916, range=0..20000)
# length of each ramp
division = Division(A=subtraction_2, B=amount_of_ramp)
repeat = RepeatData(Data=division, Length=subtraction)
repeat_2 = RepeatData(Data=landing_depth, Length=subtraction)
panel = Panel(repeat)
panel_2 = Panel(repeat_2)
dom = ConstructDomain(DomainStart="0", DomainEnd=height)
division_2 = Division(A=height, B=subtraction_2)
div = DivideDomain(Domain=dom, Count=amount_of_ramp)  # -> graft(Segments)
multiplication_2 = Multiplication(A=division_2, B="100")
weave = Weave(Pattern=[0, 1], Stream0=panel, Stream1=panel_2, NullGaps=False)
# stairs slope
panel_3 = Panel(multiplication_2)
ma = MassAddition(Input=weave)  # -> Result, PartialResults
eval = EvaluateLength(Curve=crv, Length=ma.PartialResults, Normalized=Toggle(False))  # -> Point, Tangent, Parameter
number_slider = Slider(30, range=0..50)
panel_4 = Panel(ma.PartialResults)
# shatter curve
shatter = Shatter(Curve=crv, Parameters=eval.Parameter)
divide = DivideCurve(Curve=shatter, Count=number_slider, Kinks=False)  # -> simplify(Points), Tangents, Parameters
dedomain = DeconstructDomain(Domain=div)  # -> Start, flatten(End)
div_2 = DivideDomain(Domain=div, Count=number_slider)
panel_5 = Panel(div_2)
cull_i = CullIndex(List=dedomain.End, Indices="-1", Wrap=True)  # -> graft(List)
dedomain_2 = DeconstructDomain(Domain=div_2)  # -> Start, End
item = ListItem(List=dedomain_2.Start, Index=0, Wrap=True)
panel_6 = Panel(dedomain_2.End)
panel_7 = Panel(item)
ins = InsertItems(List=dedomain_2.End, Item=panel_7, Indices=Slider(0, range=0..100), Wrap=True)
panel_8 = Panel(ins)
tstat = TreeStatistics(Tree=divide.Points)  # -> Paths, Length, Count
dispatch = Dispatch(List=tstat.Paths, DispatchPattern=[True, False])  # -> ListA, ListB
branch = TreeBranch(Tree=divide.Points, Path=dispatch.ListA, MaintainPaths=True)
branch_2 = TreeBranch(Tree=divide.Points, Path=dispatch.ListB, MaintainPaths=True)
# height of each ramp
cull_i_2 = CullIndex(List=branch_2, Indices=[0, -1], Wrap=True)  # -> simplify(List)
# height of each landing
num = Number(ins)
num_2 = Number(cull_i)
match = MatchTree(Tree=num, Guide=branch)
match_2 = MatchTree(Tree=num_2, Guide=branch_2)
Z = UnitZ(Factor=match)
Z_2 = UnitZ(Factor=match_2)
move = Move(Geometry=branch, Motion=Z)  # -> Geometry, Transform
move_2 = Move(Geometry=cull_i_2, Motion=Z_2)  # -> Geometry, Transform
merge = Merge(Data1=move.Geometry, Data2=move_2.Geometry)  # -> flatten(Result)
pline = PolyLine(Vertices=merge, Closed=False)
crv_cp = CurveClosestPoint(Point=merge, Curve=pline)  # -> Point, Parameter, Distance
eval_2 = EvaluateCurve(Curve=pline, Parameter=crv_cp.Parameter)  # -> Point, Tangent, Angle
Z_3 = UnitZ(Factor=1)
ramp_width = Slider(3000, range=0..10000)
xprod = CrossProduct(VectorA=eval_2.Tangent, VectorB=Z_3, Unitize=False)  # -> Vector, Length
neg = Negative(Value=ramp_width)
line = LineSDL(Start=crv_cp.Point, Direction=xprod.Vector, Length=ramp_width)
line_2 = LineSDL(Start=crv_cp.Point, Direction=xprod.Vector, Length=neg)
join = JoinCurves(Curves=[line_2, line], Preserve=False)
loft = Loft(Curves=join, Options={Adjust=False, Closed=False, LoftEnds=0, LoftSimp=0, LoftType=0, Rebuild=10, Refit=0.01})
