# Grasshopper definition spiral_ramp.gh (Grasshopper 1.0.7)

pt = Point(<point referenced from the Rhino model>)
rad = Radians(Degrees=Slider(106, range=0..360))
rad_2 = Radians(Degrees=Slider(360, range=0..360))
angle = Slider(10, range=0..100)
pt_2 = ConstructPoint(XCoordinate=0, YCoordinate=0, ZCoordinate=0)
number_slider = Slider(312, range=0..1000)
number_slider_2 = Slider(199, range=0..1000)
# radius
number_slider_3 = Slider(4500, range=0..10000)
pt_3 = PointPolar(BasePlane=pt, XYAngle=rad_2, ZAngle=rad, Offset=Slider(9, range=0..100))
pi = Pi(Factor=Slider(2, range=0..10))
pi_2 = Pi(Factor=Slider(7, range=0..10))
number_slider_4 = Slider(100, range=0..100)
division = Division(A=Slider(360, range=0..1000), B=angle)
pt_4 = Point(pt_2)
height = Slider(10, range=0..10)
range = Range(Domain=pi, Steps=number_slider)
range_2 = Range(Domain=pi_2, Steps=number_slider_2)
panel = Panel(range_2)
number_slider_5 = Slider(3600, range=0..10000)
X = UnitX(Factor=number_slider_3)
ln = Line(StartPoint=pt, EndPoint=pt_3)
panel_2 = Panel(range)
series = Series(Start=0, Step=division, Count=number_slider_4)
move = Move(Geometry=pt_4, Motion=X)  # -> Geometry, Transform
series_2 = Series(Start=height, Step=height, Count=number_slider_4)
number_slider_6 = Slider(4500, range=0..10000)
number_slider_7 = Slider(3000, range=0..10000)
range_3 = Range(Domain=Slider(3600, range=0..10000), Steps=number_slider)
range_4 = Range(Domain=Slider(3600, range=0..10000), Steps=number_slider_2)
rotate = Rotate(Geometry=move.Geometry, Angle=degrees(series), Plane=PlaneXY(0, 0, 0))  # -> Geometry, Transform
Z = UnitZ(Factor=series_2)
pt_5 = Point(<point referenced from the Rhino model>)
pt_6 = Point(<point referenced from the Rhino model>)
Z_2 = UnitZ(Factor=range_3)
Z_3 = UnitZ(Factor=range_4)
dom = ConstructDomain(DomainStart=Slider(1500, range=0..10000), DomainEnd=Slider(4500, range=0..10000))
move_2 = Move(Geometry=rotate.Geometry, Motion=Z)  # -> Geometry, Transform
range_5 = Range(Domain=dom, Steps=number_slider_2)
number_slider_8 = Slider(3000, range=0..10000)
pt_7 = PointPolar(BasePlane=pt_5, XYAngle=range, ZAngle=0, Offset=number_slider_6)
pt_8 = PointPolar(BasePlane=pt_6, XYAngle=range_2, ZAngle=0, Offset=range_5)
pt_9 = PointPolar(BasePlane=pt_5, XYAngle=range, ZAngle=0, Offset=Slider(3000, range=0..10000))
Z_4 = UnitZ(Factor=1)
intcrv = Interpolate(Vertices=move_2.Geometry, Degree=3, Periodic=False, KnotStyle=1)  # -> Curve, Length, Domain
move_3 = Move(Geometry=pt_7, Motion=Z_2)  # -> Geometry, Transform
move_4 = Move(Geometry=pt_8, Motion=Z_3)  # -> Geometry, Transform
move_5 = Move(Geometry=pt_9, Motion=Z_2)  # -> Geometry, Transform
offset = OffsetCurve(Curve=intcrv.Curve, Distance=Slider(-3000, range=-5000..10000), Plane=PlaneXY(0, 0, 0), Corners=1)
extr = Extrude(Base=intcrv.Curve, Direction=Z_4)
cir = Circle(Plane=pt_5, Radius=number_slider_6)
cir_2 = Circle(Plane=pt_6, Radius=Slider(3460, range=0..10000))
intcrv_2 = Interpolate(Vertices=move_4.Geometry, Degree=3, Periodic=False, KnotStyle=1)  # -> Curve, Length, Domain
ln_2 = Line(StartPoint=move_3.Geometry, EndPoint=move_5.Geometry)
end = EndPoints(Curve=intcrv.Curve)  # -> Start, End
end_2 = EndPoints(Curve=offset)  # -> Start, End
loft = Loft(Curves=ln_2, Options={Adjust=False, Closed=False, LoftEnds=0, LoftSimp=0, LoftType=0, Rebuild=10, Refit=0.01})
crv_cp = CurveClosestPoint(Point=move_4.Geometry, Curve=intcrv_2.Curve)  # -> Point, Parameter, Distance
ln_3 = Line(StartPoint=end.Start, EndPoint=end_2.Start)
ln_4 = Line(StartPoint=end.End, EndPoint=end_2.End)
hframe = HorizontalFrame(Curve=intcrv_2.Curve, Parameter=crv_cp.Parameter)
deplane = DeconstructPlane(Plane=hframe)  # -> Origin, XAxis, YAxis, ZAxis
swp2 = Sweep2(Rail1=intcrv.Curve, Rail2=offset, Sections=ln_3, SameHeight=False)
line = LineSDL(Start=deplane.Origin, Direction=deplane.YAxis, Length=Slider(1500, range=0..10000))
loft_2 = Loft(Curves=line, Options={Adjust=False, Closed=False, LoftEnds=0, LoftSimp=0, LoftType=0, Rebuild=10, Refit=0.01})
