# Grasshopper definition tween.gh (Grasshopper 0.9.76)
# plug-ins: CORE.GH, LunchBox

panel = Panel("based transition")  # disabled
# 1st FACADE ITERATION
panel_2 = Panel("based transition")  # disabled
panel_3 = Panel("center transition")  # disabled
panel_4 = Panel("top crv")  # disabled
panel_5 = Panel("bottom crv")  # disabled
number_slider = Slider(25, range=0..100)  # disabled
number_slider_2 = Slider(25, range=0..100)  # disabled
number_slider_3 = Slider(18, range=0..100)  # disabled
number_slider_4 = Slider(11, range=0..100)  # disabled
number_slider_5 = Slider(25, range=0..100)  # disabled
number_slider_6 = Slider(28, range=0..100)  # disabled
crv = Curve(<curve referenced from the Rhino model>)  # disabled
crv_2 = Curve(<curve referenced from the Rhino model>)  # disabled
crv_3 = Curve(<curve referenced from the Rhino model>)  # disabled
crv_4 = Curve(<curve referenced from the Rhino model>)  # disabled
crv_5 = Curve(<curve referenced from the Rhino model>)  # disabled
crv_6 = Curve(<curve referenced from the Rhino model>)  # disabled
range = Range(Domain=Domain(0, 1), Steps=number_slider_3)  # disabled
reb = RebuildCurve(Curve=crv, Count=number_slider_2, Tangents=False)  # disabled
reb_2 = RebuildCurve(Curve=crv_2, Count=number_slider_2, Tangents=False)  # disabled
range_2 = Range(Domain=Domain(0, 1), Steps=number_slider_4)  # disabled
range_3 = Range(Domain=Domain(0, 1), Steps=number_slider_6)  # disabled
graph = GraphMapper(
    range,
    x0=0,
    x1=1,
    y0=0,
    y1=1,
    container_name="Bezier",
    cpx=[0, 0.1246612072, 0.5609745383, 1],
    cpy=[0, 0.4004052281, 0.9109213948, 1])  # disabled
reb_3 = RebuildCurve(Curve=crv_3, Count=number_slider, Tangents=False)  # disabled
reb_4 = RebuildCurve(Curve=crv_4, Count=number_slider, Tangents=False)  # disabled
reb_5 = RebuildCurve(Curve=crv_6, Count=number_slider_5, Tangents=False)  # disabled
reb_6 = RebuildCurve(Curve=crv_5, Count=number_slider_5, Tangents=False)  # disabled
graph_2 = GraphMapper(
    range_2,
    x0=0,
    x1=1,
    y0=0,
    y1=1,
    container_name="Bezier",
    cpx=[0, 0.4434783459, 0.8028984666, 1],
    cpy=[0, 0.1072462797, 0.5246374011, 1])  # disabled
graph_3 = GraphMapper(
    range_3,
    x0=0,
    x1=1,
    y0=0,
    y1=1,
    container_name="Bezier",
    cpx=[0, 0.2074549645, 0.7754335403, 1],
    cpy=[0, 0.3895281553, 0.4902069569, 1])  # disabled
tweencrv = TweenCurve(CurveA=reb_2, CurveB=reb, Factor=graph, BlendType=0)  # disabled
tweencrv_2 = TweenCurve(CurveA=reb_4, CurveB=reb_3, Factor=graph_2, BlendType=0)  # disabled
tweencrv_3 = TweenCurve(CurveA=reb_6, CurveB=reb_5, Factor=graph_3, BlendType=0)  # disabled

number_slider_7 = Slider(120, range=0..200)  # disabled
number_slider_8 = Slider(15, range=0..1000)  # disabled
srf = Surface(<surface referenced from the Rhino model>)  # disabled
diamond = DiamondPanels(Surface=srf, UDivisions=number_slider_8, VDivisions=number_slider_7)  # -> DiamondPanels, TriPanels; disabled
number_slider_9 = Slider(27, range=0..100)  # disabled
number_slider_10 = Slider(12, range=0..100)  # disabled
srf_2 = Surface([diamond.TriPanels, diamond.DiamondPanels])  # disabled
crv_7 = Curve(<curve referenced from the Rhino model>)  # disabled
crv_8 = Curve(<curve referenced from the Rhino model>)  # disabled
range_4 = Range(Domain=Domain(0, 1), Steps=number_slider_10)  # disabled
reb_7 = RebuildCurve(Curve=crv_8, Count=number_slider_9, Tangents=False)  # disabled
reb_8 = RebuildCurve(Curve=crv_7, Count=number_slider_9, Tangents=False)  # disabled
graph_4 = GraphMapper(
    range_4,
    x0=0,
    x1=1,
    y0=0,
    y1=1,
    container_name="Bezier",
    cpx=[0, 0.07437754422, 0.3940652907, 1],
    cpy=[0, 0.568166554, 0.9290904403, 1])  # disabled
tweencrv_4 = TweenCurve(CurveA=reb_8, CurveB=reb_7, Factor=graph_4, BlendType=0)  # disabled
crv_9 = Curve(<curve referenced from the Rhino model>)  # disabled
crv_10 = Curve(<curve referenced from the Rhino model>)  # disabled
crv_11 = Curve(<curve referenced from the Rhino model>)  # disabled
crv_12 = Curve(<curve referenced from the Rhino model>)  # disabled
crv_13 = Curve(<curve referenced from the Rhino model>)  # disabled
crv_14 = Curve(<curve referenced from the Rhino model>)  # disabled
number_slider_11 = Slider(35, range=0..1000)  # disabled
number_slider_12 = Slider(65, range=0..1000)  # disabled
number_slider_13 = Slider(65, range=0..1000)  # disabled
number_slider_14 = Slider(30, range=0..1000)  # disabled
srf_3 = Surface(<surface referenced from the Rhino model>)  # disabled
srf_4 = Surface([<surface referenced from the Rhino model> x3055])

srf_5 = Surface(<surface referenced from the Rhino model>)
diamond_2 = DiamondPanels(Surface=srf_5, UDivisions=Slider(20, range=0..1000), VDivisions=Slider(10, range=0..1000))  # -> DiamondPanels, TriPanels
srf_6 = Surface(reparameterize(srf_4))
wires = BrepWireframe(Brep=srf_6, Density=-1)
explode = Explode(Curve=wires, Recursive=True)  # -> Segments, Vertices
frame = PanelFrame(ScaleFactor=0.5)  # -> PanelFrame, Panel
cullduplines = RemoveDuplicateLines(InputLines=explode.Segments, Tolerance=0.001)  # -> OutputLines, FirstLineIndexes
crv_15 = Curve(<curve referenced from the Rhino model>)
crv_16 = Curve(cullduplines.OutputLines)
vec = VectorXYZ(XComponent=0.5, YComponent=0.5, ZComponent=0)  # -> Vector, Length
evalsrf = EvaluateSurface(Surface=srf_6, Point=vec.Vector)  # -> Point, Normal, Frame
crv_cp = CurveClosestPoint(Point=evalsrf.Point, Curve=crv_15)  # -> Point, Parameter, Distance
panel_13 = Panel(crv_cp.Distance)
bnd = Bounds(Numbers=crv_cp.Distance)
remap = RemapNumbers(Source=Domain(0, 1), Target=Domain(0, 1))  # -> Mapped, Clipped
smaller = SmallerThan(FirstNumber=crv_cp.Distance, SecondNumber=Slider(83, range=0..1000))  # -> SmallerThan, OrEqualTo
remap_2 = RemapNumbers(Value=crv_cp.Distance, Source=bnd, Target=Domain(0, 1))  # -> Mapped, Clipped
dispatch = Dispatch(List=srf_6, DispatchPattern=smaller.SmallerThan)  # -> ListA, ListB
graph_5 = GraphMapper(
    remap_2.Mapped,
    x0=0,
    x1=1,
    y0=0,
    y1=1,
    container_name="Bezier",
    cpx=[0, 0.3349273205, 0.6331627965, 1],
    cpy=[0, 0.3533033133, 0.659137249, 1])
srf_7 = Surface(dispatch.ListA)
srf_8 = Surface(dispatch.ListB)
subtraction = Subtraction(A=1, B=graph_5)
subtraction_2 = Subtraction(A=subtraction, B=Slider(0.1, range=0..0.1))
frame_2 = PanelFrame(Panel=srf_6, ScaleFactor=subtraction_2)  # -> PanelFrame, Panel
srf_9 = Surface(frame_2.Panel)
srf_10 = Surface(frame_2.PanelFrame)

srf_11 = Surface(<surface referenced from the Rhino model>)  # disabled
tric = TrianglePanelsC(Surface=srf_3, UDivisions=number_slider_11, VDivisions=number_slider_12)  # disabled

# ----
# WEST - RIGHT PART
panel_14 = Panel("based transition")  # disabled
number_slider_15 = Slider(40, range=0..100)  # disabled
number_slider_16 = Slider(8, range=0..100)  # disabled
number_slider_17 = Slider(25, range=0..100)  # disabled
number_slider_18 = Slider(85, range=0..100)  # disabled
number_slider_19 = Slider(25, range=0..100)  # disabled
number_slider_20 = Slider(10, range=0..100)  # disabled
number_slider_21 = Slider(25, range=0..100)  # disabled
number_slider_22 = Slider(25, range=0..100)  # disabled
number_slider_23 = Slider(18, range=0..100)  # disabled
number_slider_24 = Slider(26, range=0..100)  # disabled
crv_17 = Curve(<curve referenced from the Rhino model>)  # disabled
crv_18 = Curve(<curve referenced from the Rhino model>)  # disabled
crv_19 = Curve(<curve referenced from the Rhino model>)  # disabled
crv_20 = Curve(<curve referenced from the Rhino model>)  # disabled
crv_21 = Curve(<curve referenced from the Rhino model>)  # disabled
crv_22 = Curve(<curve referenced from the Rhino model>)  # disabled
crv_23 = Curve(<curve referenced from the Rhino model>)  # disabled
crv_24 = Curve(<curve referenced from the Rhino model>)  # disabled
crv_25 = Curve(<curve referenced from the Rhino model>)  # disabled
crv_26 = Curve(<curve referenced from the Rhino model>)  # disabled
range_5 = Range(Domain=Domain(0, 1), Steps=number_slider_16)  # disabled
reb_9 = RebuildCurve(Curve=crv_17, Count=number_slider_15, Tangents=False)  # disabled
reb_10 = RebuildCurve(Curve=crv_18, Count=number_slider_15, Tangents=False)  # disabled
range_6 = Range(Domain=Domain(0, 1), Steps=number_slider_18)  # disabled
range_7 = Range(Domain=Domain(0, 1), Steps=number_slider_20)  # disabled
range_8 = Range(Domain=Domain(0, 1), Steps=number_slider_23)  # disabled
range_9 = Range(Domain=Domain(0, 1), Steps=number_slider_24)  # disabled
reb_11 = RebuildCurve(Curve=crv_19, Count=number_slider_17, Tangents=False)  # disabled
graph_6 = GraphMapper(
    range_5,
    x0=0,
    x1=1,
    y0=0,
    y1=1,
    container_name="Bezier",
    cpx=[0, 0, 0.440113008, 1],
    cpy=[0, 0.4817739129, 0.8023305535, 1])  # disabled
reb_12 = RebuildCurve(Curve=crv_20, Count=number_slider_17, Tangents=False)  # disabled
reb_13 = RebuildCurve(Curve=crv_21, Count=number_slider_19, Tangents=False)  # disabled
reb_14 = RebuildCurve(Curve=crv_23, Count=number_slider_21, Tangents=False)  # disabled
reb_15 = RebuildCurve(Curve=crv_22, Count=number_slider_19, Tangents=False)  # disabled
reb_16 = RebuildCurve(Curve=crv_26, Count=number_slider_22, Tangents=False)  # disabled
reb_17 = RebuildCurve(Curve=crv_24, Count=number_slider_21, Tangents=False)  # disabled
reb_18 = RebuildCurve(Curve=crv_25, Count=number_slider_22, Tangents=False)  # disabled
graph_7 = GraphMapper(
    range_6,
    x0=0,
    x1=1,
    y0=0,
    y1=1,
    container_name="Bezier",
    cpx=[0, 0.3051899374, 0.6775096655, 1],
    cpy=[0, 0.2362847924, 0.6332998872, 1])  # disabled
graph_8 = GraphMapper(
    range_7,
    x0=0,
    x1=1,
    y0=0,
    y1=1,
    container_name="Bezier",
    cpx=[0, 0.4434783459, 0.8028984666, 1],
    cpy=[0, 0.1072462797, 0.5246374011, 1])  # disabled
graph_9 = GraphMapper(
    range_8,
    x0=0,
    x1=1,
    y0=0,
    y1=1,
    container_name="Bezier",
    cpx=[0, 0.2512472272, 0.8028984666, 1],
    cpy=[0, 0.365853548, 0.5246374011, 1])  # disabled
graph_10 = GraphMapper(
    range_9,
    x0=0,
    x1=1,
    y0=0,
    y1=1,
    container_name="Bezier",
    cpx=[0, 0.6582721472, 0.8909717798, 1],
    cpy=[0, 0.06460881233, 0.532384038, 1])  # disabled
tweencrv_5 = TweenCurve(CurveA=reb_12, CurveB=reb_11, Factor=graph_7, BlendType=0)  # disabled
tweencrv_6 = TweenCurve(CurveA=reb_15, CurveB=reb_13, Factor=graph_8, BlendType=0)  # disabled
tweencrv_7 = TweenCurve(CurveA=reb_18, CurveB=reb_16, Factor=graph_10, BlendType=0)  # disabled
tweencrv_8 = TweenCurve(CurveA=reb_17, CurveB=reb_14, Factor=graph_9, BlendType=0)  # disabled
tweencrv_9 = TweenCurve(CurveA=reb_10, CurveB=reb_9, Factor=graph_6, BlendType=0)  # disabled
crv_27 = Curve([tweencrv_5, tweencrv_9, tweencrv_6, tweencrv_8, tweencrv_7])  # disabled

# ----
# WEST - RIGHT PART
panel_29 = Panel("based transition")  # disabled
tric_2 = TrianglePanelsC(Surface=srf_11, UDivisions=number_slider_13, VDivisions=number_slider_14)  # disabled
trib = TrianglePanelsB(Surface=srf_3, UDivisions=number_slider_11, VDivisions=number_slider_12)  # disabled
wires_2 = BrepWireframe(Brep=tric, Density=-1)  # disabled
disc = Discontinuity(Curve=wires_2, Level=1)  # -> Points, Parameters; disabled
diamond_3 = DiamondPanels(Surface=srf_11, UDivisions=number_slider_14, VDivisions=number_slider_13)  # -> DiamondPanels, TriPanels; disabled
trib_2 = TrianglePanelsB(Surface=srf_11, UDivisions=number_slider_13, VDivisions=number_slider_14)  # disabled
number_slider_25 = Slider(25, range=0..100)  # disabled
number_slider_26 = Slider(40, range=0..100)  # disabled
number_slider_27 = Slider(75, range=0..100)  # disabled
number_slider_28 = Slider(18, range=0..100)  # disabled
number_slider_29 = Slider(25, range=0..100)  # disabled
number_slider_30 = Slider(56, range=0..100)  # disabled
number_slider_31 = Slider(25, range=0..100)  # disabled
number_slider_32 = Slider(25, range=0..100)  # disabled
number_slider_33 = Slider(20, range=0..100)  # disabled
number_slider_34 = Slider(20, range=0..100)  # disabled
flatten = FlattenTree(Tree=disc.Points, Path="{0}")  # disabled
crv_28 = Curve(crv_11)  # disabled
crv_29 = Curve(crv_12)  # disabled
cullduppoints = RemoveDuplicatePoints(InputPoints=flatten, Tolerance=0.001)  # -> OutputPoints, FirstPointIndexes; disabled
crv_30 = Curve(crv_12)  # disabled
crv_31 = Curve(crv_13)  # disabled
crv_32 = Curve(crv_13)  # disabled
crv_33 = Curve(crv_14)  # disabled
crv_34 = Curve(crv_14)  # disabled
crv_35 = Curve(crv_9)  # disabled
crv_36 = Curve(crv_9)  # disabled
crv_37 = Curve(crv_10)  # disabled
pt = Point([<point referenced from the Rhino model> x4651])  # disabled
range_10 = Range(Domain=Domain(0, 1), Steps=number_slider_27)  # disabled
number_slider_35 = Slider(2, range=0..10)  # disabled
reb_19 = RebuildCurve(Curve=crv_28, Count=number_slider_26, Tangents=False)  # disabled
edges = BrepEdges(Brep=[diamond_3.DiamondPanels, diamond_3.TriPanels])  # -> Naked, Interior, NonManifold; disabled
reb_20 = RebuildCurve(Curve=crv_29, Count=number_slider_26, Tangents=False)  # disabled
range_11 = Range(Domain=Domain(0, 1), Steps=number_slider_28)  # disabled
range_12 = Range(Domain=Domain(0, 1), Steps=number_slider_30)  # disabled
range_13 = Range(Domain=Domain(0, 1), Steps=number_slider_33)  # disabled
range_14 = Range(Domain=Domain(0, 1), Steps=number_slider_34)  # disabled
reb_21 = RebuildCurve(Curve=crv_30, Count=number_slider_25, Tangents=False)  # disabled
graph_11 = GraphMapper(
    range_10,
    x0=0,
    x1=1,
    y0=0,
    y1=1,
    container_name="Bezier",
    cpx=[0, 0.378393203, 0.5664363503, 1],
    cpy=[0, 0.4495973587, 0.842663765, 1])  # disabled
reb_22 = RebuildCurve(Curve=crv_31, Count=number_slider_25, Tangents=False)  # disabled
reb_23 = RebuildCurve(Curve=crv_32, Count=number_slider_29, Tangents=False)  # disabled
Y = UnitY(Factor=1)  # disabled
reb_24 = RebuildCurve(Curve=crv_34, Count=number_slider_31, Tangents=False)  # disabled
reb_25 = RebuildCurve(Curve=crv_33, Count=number_slider_29, Tangents=False)  # disabled
reb_26 = RebuildCurve(Curve=crv_37, Count=number_slider_32, Tangents=False)  # disabled
reb_27 = RebuildCurve(Curve=crv_35, Count=number_slider_31, Tangents=False)  # disabled
reb_28 = RebuildCurve(Curve=crv_36, Count=number_slider_32, Tangents=False)  # disabled
number_slider_36 = Slider(30.2, range=0..110)  # disabled
graph_12 = GraphMapper(
    range_11,
    x0=0,
    x1=1,
    y0=0,
    y1=1,
    container_name="Bezier",
    cpx=[0, 0.3051899374, 0.6775096655, 1],
    cpy=[0, 0.2362847924, 0.6332998872, 1])  # disabled
graph_13 = GraphMapper(
    range_12,
    x0=0,
    x1=1,
    y0=0,
    y1=1,
    container_name="Bezier",
    cpx=[0, 0.4434783459, 0.8028984666, 1],
    cpy=[0, 0.1072462797, 0.5246374011, 1])  # disabled
graph_14 = GraphMapper(
    range_13,
    x0=0,
    x1=1,
    y0=0,
    y1=1,
    container_name="Bezier",
    cpx=[0, 0.3003354371, 0.5644973516, 1],
    cpy=[0, 0.5191420317, 0.7773685455, 1])  # disabled
graph_15 = GraphMapper(
    range_14,
    x0=0,
    x1=1,
    y0=0,
    y1=1,
    container_name="Bezier",
    cpx=[0, 0.5405079126, 0.8135738373, 1],
    cpy=[0, 0.1703960299, 0.5859304667, 1])  # disabled
number_slider_37 = Slider(0.3, range=0..1)  # disabled
circle = CircleCNR(Center=pt, Normal=Y, Radius=number_slider_35)  # disabled
tweencrv_10 = TweenCurve(CurveA=reb_22, CurveB=reb_21, Factor=graph_12, BlendType=0)  # disabled
crv_38 = Curve(<curve referenced from the Rhino model>)  # disabled
tweencrv_11 = TweenCurve(CurveA=reb_25, CurveB=reb_23, Factor=graph_13, BlendType=0)  # disabled
tweencrv_12 = TweenCurve(CurveA=reb_28, CurveB=reb_26, Factor=graph_15, BlendType=0)  # disabled
tweencrv_13 = TweenCurve(CurveA=reb_27, CurveB=reb_24, Factor=graph_14, BlendType=0)  # disabled
tweencrv_14 = TweenCurve(CurveA=reb_20, CurveB=reb_19, Factor=graph_11, BlendType=0)  # disabled
crv_39 = Curve(<curve referenced from the Rhino model>)  # disabled
crv_40 = Curve(<curve referenced from the Rhino model>)  # disabled
crv_41 = Curve(<curve referenced from the Rhino model>)  # disabled
crv_cp_2 = CurveClosestPoint(Point=pt, Curve=crv_38)  # -> Point, Parameter, Distance; disabled
dom = ConstructDomain(DomainStart=number_slider_37, DomainEnd=number_slider_36)  # disabled
bnd_2 = Bounds(Numbers=crv_cp_2.Distance)  # disabled
remap_3 = RemapNumbers(Value=crv_cp_2.Distance, Source=bnd_2, Target=dom)  # -> Mapped, Clipped; disabled
X = UnitX(Factor=remap_3.Mapped)  # disabled
move = Move(Geometry=pt, Motion=X)  # -> Geometry, Transform; disabled
ln = Line(StartPoint=move.Geometry, EndPoint=pt)  # disabled
cir = Circle(Plane=pt, Radius=remap_3.Mapped)  # disabled
circle_2 = CircleCNR(Center=pt, Normal=Y, Radius=remap_3.Mapped)  # disabled
crv_42 = Curve([tweencrv_10, tweencrv_14, tweencrv_11, tweencrv_13, tweencrv_12])  # disabled
number_slider_38 = Slider(25, range=0..100)  # disabled
number_slider_39 = Slider(40, range=0..100)  # disabled
number_slider_40 = Slider(21, range=0..100)  # disabled
number_slider_41 = Slider(38, range=0..100)  # disabled
# WEST -LEFT PART
panel_50 = Panel("based transition")  # disabled
crv_43 = Curve(crv_39)  # disabled
crv_44 = Curve(crv_40)  # disabled
crv_45 = Curve(crv_40)  # disabled
crv_46 = Curve(crv_41)  # disabled
range_15 = Range(Domain=Domain(0, 1), Steps=number_slider_41)  # disabled
reb_29 = RebuildCurve(Curve=crv_43, Count=number_slider_39, Tangents=False)  # disabled
reb_30 = RebuildCurve(Curve=crv_44, Count=number_slider_39, Tangents=False)  # disabled
range_16 = Range(Domain=Domain(0, 1), Steps=number_slider_40)  # disabled
reb_31 = RebuildCurve(Curve=crv_45, Count=number_slider_38, Tangents=False)  # disabled
graph_16 = GraphMapper(
    range_15,
    x0=0,
    x1=1,
    y0=0,
    y1=1,
    container_name="Bezier",
    cpx=[0, 0.7335682511, 0.2698001564, 1],
    cpy=[0, 0.05647909641, 0.9187911153, 1])  # disabled
reb_32 = RebuildCurve(Curve=crv_46, Count=number_slider_38, Tangents=False)  # disabled
graph_17 = GraphMapper(
    range_16,
    x0=0,
    x1=1,
    y0=0,
    y1=1,
    container_name="Bezier",
    cpx=[0, 0.05433367193, 0.2822831869, 1],
    cpy=[0, 0.7922893763, 0.9533797503, 1])  # disabled
number_slider_42 = Slider(50, range=0..100)  # disabled
number_slider_43 = Slider(2, range=0..100)  # disabled
crv_47 = Curve([<curve referenced from the Rhino model> x888])  # disabled
number_slider_44 = Slider(25, range=0..100)  # disabled
number_slider_45 = Slider(40, range=0..100)  # disabled
number_slider_46 = Slider(8, range=0..100)  # disabled
number_slider_47 = Slider(85, range=0..100)  # disabled
number_slider_48 = Slider(25, range=0..100)  # disabled
tweencrv_15 = TweenCurve(CurveA=reb_32, CurveB=reb_31, Factor=graph_17, BlendType=0)  # disabled
number_slider_49 = Slider(10, range=0..100)  # disabled
number_slider_50 = Slider(25, range=0..100)  # disabled
number_slider_51 = Slider(25, range=0..100)  # disabled
number_slider_52 = Slider(18, range=0..100)  # disabled
number_slider_53 = Slider(26, range=0..100)  # disabled
srf_12 = Surface([<surface referenced from the Rhino model> x2])  # disabled
graft = GraftTree(Tree=crv_47, IncludeEmptyLists=True, IncludeNullItems=True)  # disabled
tweencrv_16 = TweenCurve(CurveA=reb_30, CurveB=reb_29, Factor=graph_16, BlendType=0)  # disabled
graft_2 = GraftTree(Tree=crv_47, IncludeEmptyLists=True, IncludeNullItems=True)  # disabled
crv_48 = Curve(<curve referenced from the Rhino model>)  # disabled
crv_49 = Curve(<curve referenced from the Rhino model>)  # disabled
crv_50 = Curve(<curve referenced from the Rhino model>)  # disabled
crv_51 = Curve(<curve referenced from the Rhino model>)  # disabled
crv_52 = Curve(<curve referenced from the Rhino model>)  # disabled
crv_53 = Curve(<curve referenced from the Rhino model>)  # disabled
disc_2 = Discontinuity(Curve=graft, Level=1)  # -> Points, Parameters; disabled
crv_54 = Curve(<curve referenced from the Rhino model>)  # disabled
crv_55 = Curve(<curve referenced from the Rhino model>)  # disabled
crv_56 = Curve(<curve referenced from the Rhino model>)  # disabled
crv_57 = Curve(<curve referenced from the Rhino model>)  # disabled
range_17 = Range(Domain=Domain(0, 1), Steps=number_slider_46)  # disabled
pcen = PolygonCenter(Polyline=graft_2)  # -> CenterV, CenterE, CenterA; disabled
mesh_uv = MeshSurface(Surface=srf_12, UCount=number_slider_43, VCount=number_slider_42, Overhang=True, Equalize=False)  # disabled
reb_33 = RebuildCurve(Curve=crv_48, Count=number_slider_45, Tangents=False)  # disabled
reb_34 = RebuildCurve(Curve=crv_49, Count=number_slider_45, Tangents=False)  # disabled
range_18 = Range(Domain=Domain(0, 1), Steps=number_slider_47)  # disabled
range_19 = Range(Domain=Domain(0, 1), Steps=number_slider_49)  # disabled
range_20 = Range(Domain=Domain(0, 1), Steps=number_slider_52)  # disabled
range_21 = Range(Domain=Domain(0, 1), Steps=number_slider_53)  # disabled
reb_35 = RebuildCurve(Curve=crv_50, Count=number_slider_44, Tangents=False)  # disabled
graph_18 = GraphMapper(
    range_17,
    x0=0,
    x1=1,
    y0=0,
    y1=1,
    container_name="Bezier",
    cpx=[0, 0, 0.440113008, 1],
    cpy=[0, 0.4817739129, 0.8023305535, 1])  # disabled
reb_36 = RebuildCurve(Curve=crv_51, Count=number_slider_44, Tangents=False)  # disabled
reb_37 = RebuildCurve(Curve=crv_52, Count=number_slider_48, Tangents=False)  # disabled
reb_38 = RebuildCurve(Curve=crv_54, Count=number_slider_50, Tangents=False)  # disabled
reb_39 = RebuildCurve(Curve=crv_53, Count=number_slider_48, Tangents=False)  # disabled
reb_40 = RebuildCurve(Curve=crv_57, Count=number_slider_51, Tangents=False)  # disabled
reb_41 = RebuildCurve(Curve=crv_55, Count=number_slider_50, Tangents=False)  # disabled
reb_42 = RebuildCurve(Curve=crv_56, Count=number_slider_51, Tangents=False)  # disabled
dup = DuplicateData(Data=pcen.CenterE, Number=4, Order=True)  # disabled
graph_19 = GraphMapper(
    range_18,
    x0=0,
    x1=1,
    y0=0,
    y1=1,
    container_name="Bezier",
    cpx=[0, 0.3051899374, 0.6775096655, 1],
    cpy=[0, 0.2362847924, 0.6332998872, 1])  # disabled
graph_20 = GraphMapper(
    range_19,
    x0=0,
    x1=1,
    y0=0,
    y1=1,
    container_name="Bezier",
    cpx=[0, 0.4434783459, 0.8028984666, 1],
    cpy=[0, 0.1072462797, 0.5246374011, 1])  # disabled
graph_21 = GraphMapper(
    range_20,
    x0=0,
    x1=1,
    y0=0,
    y1=1,
    container_name="Bezier",
    cpx=[0, 0.2512472272, 0.8028984666, 1],
    cpy=[0, 0.365853548, 0.5246374011, 1])  # disabled
graph_22 = GraphMapper(
    range_21,
    x0=0,
    x1=1,
    y0=0,
    y1=1,
    container_name="Bezier",
    cpx=[0, 0.6582721472, 0.8909717798, 1],
    cpy=[0, 0.06460881233, 0.532384038, 1])  # disabled
simplify = SimplifyTree(Tree=disc_2.Points, Front=disc_2.Points)  # disabled
simplify_2 = SimplifyTree(Tree=dup, Front=False)  # disabled
tweencrv_17 = TweenCurve(CurveA=reb_36, CurveB=reb_35, Factor=graph_19, BlendType=0)  # disabled
tweencrv_18 = TweenCurve(CurveA=reb_39, CurveB=reb_37, Factor=graph_20, BlendType=0)  # disabled
tweencrv_19 = TweenCurve(CurveA=reb_42, CurveB=reb_40, Factor=graph_22, BlendType=0)  # disabled
tweencrv_20 = TweenCurve(CurveA=reb_41, CurveB=reb_38, Factor=graph_21, BlendType=0)  # disabled
tweencrv_21 = TweenCurve(CurveA=reb_34, CurveB=reb_33, Factor=graph_18, BlendType=0)  # disabled
graft_3 = GraftTree(Tree=simplify, IncludeEmptyLists=True, IncludeNullItems=True)  # disabled
path_mapper = PathMapper(graft_3, source="{A;B;C}", target="{A;C}")  # disabled
graft_4 = GraftTree(Tree=simplify_2, IncludeEmptyLists=True, IncludeNullItems=True)  # disabled
ln_2 = Line(StartPoint=graft_4, EndPoint=path_mapper)  # disabled
crv_58 = Curve([tweencrv_15, tweencrv_16])  # disabled
panel_65 = Panel(path_mapper)  # disabled
crv_59 = Curve([tweencrv_17, tweencrv_21, tweencrv_18, tweencrv_20, tweencrv_19])  # disabled
brep = Brep([<brep referenced from the Rhino model> x138])
crv_60 = Curve(<curve referenced from the Rhino model>)
# 3d offset
srf_13 = Surface(brep)
srf_14 = Surface(reparameterize(srf_13))
wires_3 = BrepWireframe(Brep=srf_14, Density=-1)
explode_2 = Explode(Curve=wires_3, Recursive=True)  # -> Segments, Vertices
cullduplines_2 = RemoveDuplicateLines(InputLines=explode_2.Segments, Tolerance=0.001)  # -> OutputLines, FirstLineIndexes
crv_61 = Curve(cullduplines_2.OutputLines)
vec_2 = VectorXYZ(XComponent=0.5, YComponent=0.5, ZComponent=0)  # -> Vector, Length
edges_2 = BrepEdges(Brep=srf_14)  # -> Naked, Interior, NonManifold
evalsrf_2 = EvaluateSurface(Surface=srf_14, Point=vec_2.Vector)  # -> Point, Normal, Frame
join = JoinCurves(Curves=edges_2.Naked, Preserve=False)
pt_2 = Point(evalsrf_2.Point)
area = Area(Geometry=join)  # -> Area, Centroid
crv_cp_3 = CurveClosestPoint(Point=evalsrf_2.Point, Curve=crv_60)  # -> Point, Parameter, Distance
bnd_3 = Bounds(Numbers=crv_cp_3.Distance)
remap_4 = RemapNumbers(Source=Domain(0, 1), Target=Domain(0, 1))  # -> Mapped, Clipped
smaller_2 = SmallerThan(FirstNumber=crv_cp_3.Distance, SecondNumber=Slider(83, range=0..1000))  # -> SmallerThan, OrEqualTo
remap_5 = RemapNumbers(Value=crv_cp_3.Distance, Source=bnd_3, Target=Domain(0, 1))  # -> Mapped, Clipped
graph_23 = GraphMapper(
    remap_5.Mapped,
    x0=0,
    x1=1,
    y0=0,
    y1=1,
    container_name="Bezier",
    cpx=[0, 0, 0.622586906, 1],
    cpy=[0, 0.4870004058, 0.6674592495, 1])
dispatch_2 = Dispatch(List=srf_14, DispatchPattern=smaller_2.SmallerThan)  # -> ListA, ListB
flatten_2 = FlattenTree(Tree=area.Centroid, Path="{0}")
srf_15 = Surface(dispatch_2.ListA)
srf_16 = Surface(dispatch_2.ListB)
subtraction_3 = Subtraction(A=1, B=graph_23)
subtraction_4 = Subtraction(A=subtraction_3, B=Slider(0.1, range=0..0.1))
multiplication = Multiplication(A=subtraction_3, B=Slider(-0.475, range=-1..1))
Y_2 = UnitY(Factor=multiplication)
move_2 = Move(Geometry=srf_14, Motion=Y_2)  # -> Geometry, Transform
X_2 = UnitX(Factor=subtraction_4)
X_3 = UnitX(Factor=1)
panel_66 = Panel(multiplication)
rot3d = Rotate3D(Geometry=srf_14, Angle=multiplication, Center=flatten_2, Axis=X_3)  # -> Geometry, Transform

diamond_4 = DiamondPanels(Surface=srf_3, UDivisions=number_slider_12, VDivisions=number_slider_11)  # -> DiamondPanels, TriPanels; disabled
hex = HexagonCells(Surface=srf_3, UDivisions=number_slider_11, VDivisions=number_slider_12, TParameter=0.25)  # -> HexagonCells, Centers; disabled
clean = CleanTree(RemoveNulls=True, RemoveInvalid=True, RemoveEmpty=False, Tree=hex.Centers)  # disabled
clean_2 = CleanTree(RemoveNulls=True, RemoveInvalid=True, RemoveEmpty=False, Tree=hex.HexagonCells)  # disabled
boundary = BoundarySurfaces(Edges=hex.HexagonCells)  # disabled
srf_17 = Surface(reparameterize(boundary))  # disabled
wires_4 = BrepWireframe(Brep=srf_17, Density=-1)  # disabled
explode_3 = Explode(Curve=wires_4, Recursive=True)  # -> Segments, Vertices; disabled
cullduplines_3 = RemoveDuplicateLines(InputLines=explode_3.Segments, Tolerance=0.001)  # -> OutputLines, FirstLineIndexes; disabled
crv_62 = Curve(<curve referenced from the Rhino model>)  # disabled
crv_63 = Curve(cullduplines_3.OutputLines)  # disabled
number_slider_54 = Slider(83, range=0..1000)  # disabled
vec_3 = VectorXYZ(XComponent=0.5, YComponent=0.5, ZComponent=0)  # -> Vector, Length; disabled
panel_67 = Panel(hex.Centers)  # disabled
evalsrf_3 = EvaluateSurface(Surface=srf_17, Point=vec_3.Vector)  # -> Point, Normal, Frame; disabled
crv_cp_4 = CurveClosestPoint(Point=evalsrf_3.Point, Curve=crv_62)  # -> Point, Parameter, Distance; disabled
bnd_4 = Bounds(Numbers=crv_cp_4.Distance)  # disabled
remap_6 = RemapNumbers(Source=Domain(0, 1), Target=Domain(0, 1))  # -> Mapped, Clipped; disabled
smaller_3 = SmallerThan(FirstNumber=crv_cp_4.Distance, SecondNumber=number_slider_54)  # -> SmallerThan, OrEqualTo; disabled
remap_7 = RemapNumbers(Value=crv_cp_4.Distance, Source=bnd_4, Target=Domain(0, 1))  # -> Mapped, Clipped; disabled
dispatch_3 = Dispatch(List=srf_17, DispatchPattern=smaller_3.SmallerThan)  # -> ListA, ListB; disabled
graph_24 = GraphMapper(
    remap_7.Mapped,
    x0=0,
    x1=1,
    y0=0,
    y1=1,
    container_name="Bezier",
    cpx=[0, 0.01037774608, 0.6846145391, 1],
    cpy=[0, 0.6736229062, 0.5994819999, 1])  # disabled
number_slider_55 = Slider(0.1, range=0..0.1)  # disabled
srf_18 = Surface(dispatch_3.ListA)  # disabled
srf_19 = Surface(dispatch_3.ListB)  # disabled
subtraction_5 = Subtraction(A=1, B=graph_24)  # disabled
subtraction_6 = Subtraction(A=subtraction_5, B=number_slider_55)  # disabled
frame_3 = PanelFrame(Panel=srf_17, ScaleFactor=subtraction_6)  # -> PanelFrame, Panel; disabled
srf_20 = Surface(frame_3.Panel)  # disabled
srf_21 = Surface(frame_3.PanelFrame)  # disabled

crv_64 = Curve(hex.HexagonCells)  # disabled
pcen_2 = PolygonCenter(Polyline=crv_64)  # -> CenterV, CenterE, CenterA; disabled
crv_65 = Curve(<curve referenced from the Rhino model>)  # disabled
number_slider_56 = Slider(0, range=0..10)  # disabled
number_slider_57 = Slider(5, range=0..10)  # disabled
crv_cp_5 = CurveClosestPoint(Point=pcen_2.CenterE, Curve=crv_65)  # -> Point, Parameter, Distance; disabled
dom_2 = ConstructDomain(DomainStart=number_slider_56, DomainEnd=number_slider_57)  # disabled
bnd_5 = Bounds(Numbers=crv_cp_5.Distance)  # disabled
number_slider_58 = Slider(-0.2, range=-1..1)  # disabled
remap_8 = RemapNumbers(Value=crv_cp_5.Distance, Source=bnd_5, Target=dom_2)  # -> Mapped, Clipped; disabled
int = Integer(remap_8.Mapped)  # disabled
graft_5 = GraftTree(Tree=crv_64, IncludeEmptyLists=True, IncludeNullItems=True)  # disabled
graft_6 = GraftTree(Tree=pcen_2.CenterE, IncludeEmptyLists=True, IncludeNullItems=True)  # disabled
series = Series(Start=0.8, Step=number_slider_58, Count=int)  # disabled
lng = ListLength(List=series)  # disabled
dup_2 = DuplicateData(Data=graft_5, Number=lng, Order=True)  # disabled
dup_3 = DuplicateData(Data=graft_6, Number=lng, Order=True)  # disabled
simplify_3 = SimplifyTree(Tree=series, Front=False)  # disabled
simplify_4 = SimplifyTree(Tree=dup_2, Front=False)  # disabled
simplify_5 = SimplifyTree(Tree=dup_3, Front=False)  # disabled
number_slider_59 = Slider(7749, range=0..100000)  # disabled
scale = Scale(Geometry=simplify_4, Center=simplify_5, Factor=simplify_3)  # -> Geometry, Transform; disabled
crv_66 = Curve([scale.Geometry, crv_64])  # disabled
reduce = RandomReduce(List=flatten(crv_66), Reduction=number_slider_59, Seed=1)  # disabled
panel_68 = Panel(simplify_3)  # disabled
