# Grasshopper definition block_to_family.gh (Grasshopper 1.0.8)
# plug-ins: Rhino.Inside for Autodesk Revit

# ---- group: Step 1: Filter Block Instances
query_model_objects = QueryModelObjects(Locked=True, Hidden=True, AutoUpdateState=True)  # -> Objects, BlockInstances, Points, PointClouds, Curves, Surfaces, Extrusions, Breps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
match_text_filter = MatchTextFilter(Pattern="*Instance*", Case=True, Culture=127, MatchTextMode=1)
panel = Panel(query_model_objects.BlockInstances)
filter_content = FilterContent(Content=query_model_objects.BlockInstances, Filter=match_text_filter)

# ---- group: Step 3: Query Block Geometries
query_model_block_definitions = QueryModelBlockDefinitions(AutoUpdateState=True)
model_block_definition = ModelBlockDefinition(BlockDefinition=query_model_block_definitions)  # -> BlockDefinition, Objects, Name
model_object = ModelObject(Object=model_block_definition.Objects)  # -> Object, Geometry, Name, Layer, Visibility, Display, Drafting, Render
panel_2 = Panel(model_object.Layer)

# ---- group: Step 2: Get Instance Transforms
model_block_instance = ModelBlockInstance(BlockInstance=filter_content)  # -> BlockInstance, Transform, BlockDefinition
plane = Plane(flatten(model_block_instance.Transform))

# ---- group: Cost / Cost Per SqFt Per Panel
yellow_panel_cost = Slider(110, range=50..300)
blue_panel_cost = Slider(75, range=50..300)
zinc_panel_cost = Slider(150, range=50..300)
metal_grate_cost = Slider(100, range=50..300)

# ----
built_in_categories = BuiltInCategories("autodesk.revit.category.family:genericModel-1.0.0", SearchPattern="generic model")
query_views = QueryViews(ViewName="North - Architectural", IsDependent=False, IsTemplate=False)
query_view_elements = QueryViewElements(View=query_views, Categories=built_in_categories)
element_geometry = ElementGeometry(Elements=query_view_elements)
bounding_box = BoundingBox(Content=element_geometry, Plane=PlaneXY(0, 0, 0))  # -> Box, Box_2
evaluate_box = EvaluateBox(Box=bounding_box.Box, UParameter=0.5, VParameter=0.5, WParameter=0.5)  # -> Plane, Point, Include
tag_by_category = TagByCategory(View=query_views, Element=flatten(query_view_elements), HeadLocation=flatten(evaluate_box.Point), TrackingMode=2)
annotation_leaders = AnnotationLeaders(Annotation=tag_by_category, Leader=Toggle(False))  # -> Annotation, Leader, ShoulderLocations, EndLocations, TextLocations

# ---- group: Step 6: Map Instances to Families
model_block_definition_2 = ModelBlockDefinition(BlockDefinition=model_block_instance.BlockDefinition)  # -> BlockDefinition, Objects, Name
member_index = MemberIndex(Set=flatten(model_block_definition.Name), Member=flatten(model_block_definition_2.Name))  # -> Index, Count

# ---- group: Step 4: Prepare Subcategories
model_layer = ModelLayer(Layer=model_object.Layer)  # -> Layer, graft(Name), Hidden, Locked, DisplayColour, Material, Linetype

# ---- group: Step 6: Map Instances to Families
model_material = ModelMaterial(Material=model_layer.Material)  # -> Material, Name, Shader
add_material = AddMaterial(Name=model_material.Name, TrackingMode=2)

# ---- group: Step 5: Create Revit Families
built_in_categories_2 = BuiltInCategories("autodesk.revit.category.family:genericModel-1.0.0", SearchPattern="generic model")

# ---- group: Step 4: Prepare Subcategories (continued)
add_subcategory = AddSubCategory(Parent=built_in_categories_2, Name=model_layer.Name, TrackingMode=2)

# ---- group: Step 5: Create Revit Families (continued)
component_family_form = ComponentFamilyForm(Brep=model_object.Object, Subcategory=add_subcategory, Material=add_material)
new_component_family = NewComponentFamily(
    Overwrite=Toggle(True),
    Name=graft(model_block_definition.Name),
    Category=built_in_categories_2,
    Geometry=component_family_form)
family_types = FamilyTypes(Family=new_component_family)  # -> flatten(Types)

# ---- group: Step 6: Map Instances to Families (continued)
list_item = ListItem(List=family_types, Index=member_index.Index, Wrap=True)

# ---- group: Step 7: Place Revit Components
add_component_work_plane = AddComponentWorkPlane(Location=flatten(plane), Type=flatten(list_item), TrackingMode=2)  # -> Component, Face, WorkPlane

# ---- group: Mark
cluster = Cluster(
    parameter="Mark",
    list=add_component_work_plane.Component,
    format="Y-{0:000}",
    list_2=model_block_definition_2.Name,
    x=model_block_definition_2.Name,
    y="Yellow Panel")
cluster_2 = Cluster(
    parameter="Mark",
    list=add_component_work_plane.Component,
    format="Z-{0:000}",
    list_2=model_block_definition_2.Name,
    x=model_block_definition_2.Name,
    y="Zinc Panel")
cluster_3 = Cluster(
    parameter="Mark",
    list=add_component_work_plane.Component,
    format="B-{0:000}",
    list_2=model_block_definition_2.Name,
    x=model_block_definition_2.Name,
    y="Blue Panel")
cluster_4 = Cluster(
    parameter="Mark",
    list=add_component_work_plane.Component,
    format="M-{0:000}",
    list_2=model_block_definition_2.Name,
    x=model_block_definition_2.Name,
    y="Metal Grate Panel")

# ---- group: Manufacturer
manufacturers = Panel("""AluminaTech
ZincSmith Fabricators
MetalMakers Inc.
Ironic Iron Exteriors""")
parameter = Parameter("Manufacturer")
element_parameter = ElementParameter(Element=flatten(family_types), Parameter=parameter, Value=manufacturers)  # -> Element, Value
panel_3 = Panel(element_parameter.Value)

# ---- group: Type Mark
manufacturers_2 = Panel("""Y
Z
M
B""")
parameter_2 = Parameter("Type Mark")
element_parameter_2 = ElementParameter(Element=flatten(family_types), Parameter=parameter_2, Value=manufacturers_2)  # -> Element, Value
panel_4 = Panel(element_parameter_2.Value)

# ---- group: Cost
merge = Merge(Data1=yellow_panel_cost, Data2=blue_panel_cost, Data3=zinc_panel_cost, Data4=metal_grate_cost)
parameter_3 = Parameter("Cost")
element_parameter_3 = ElementParameter(Element=flatten(family_types), Parameter=parameter_3, Value=merge)  # -> Element, Value
panel_5 = Panel(element_parameter_3.Value)

# ==== cluster Cluster
x = ClusterInput()
y = ClusterInput()
expression = Expression(x=x, y=y, Expression="x=y")
list = ClusterInput()
list_2 = ClusterInput()
dispatch = Dispatch(List=list, DispatchPattern=expression)  # -> ListA, ListB
dispatch_2 = Dispatch(List=list_2, DispatchPattern=expression)  # -> ListA, ListB
panel = Panel(list)
list_length = ListLength(List=dispatch_2.ListA)
series = Series(Start="1", Step="1", Count=list_length)
format = ClusterInput()
parameter = ClusterInput()
format_2 = Format(Format=format, Culture=127, Data0=series)
parameter_2 = Parameter(parameter)
element_parameter = ElementParameter(Element=dispatch.ListA, Parameter=parameter_2, Value=format_2)  # -> Element, Value
panel_2 = Panel(element_parameter.Value)
