# Grasshopper definition elefront_bake_attributes.gh (Grasshopper 1.0.8)
# plug-ins: eleFront5

# ---- group: User Inputs
button = Button()
panel = Panel("*test layer 1*")
panel_2 = Panel("""Mark
Type Name
Family Name""")
panel_3 = Panel("""A-101
Generic Type
Generic Family""")
panel_4 = Panel("ElefrontBake")

# ---- group: Query Model by Layer
m_objects = QueryModelObjects(Layer=panel, Locked=True, Hidden=True, AutoUpdateState=True)
object = ModelObject(Object=m_objects)  # -> Object, Geometry, Name, Layer, Visibility, Display, Drafting, Render

# ---- group: Apply Attributes & Bake
ef_att = EleFrontAttributes(Keys=panel_2, Values=panel_3, Layer=panel, maintainBakeName=False)  # -> Attributes, Keys, Values, Name, Layer, ColourSource, DisplayColour, MaterialSource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
modratt = ModifyRhinoObjectAttributes(ReferencedObject=object.Geometry, Attributes=ef_att.Attributes, Activate=button)
